# Grasshopper definition GIRD3.ghx (Grasshopper 1.0.8)

# ---- group: 00_GLOBAL INPUTS
corner_pod_length = Slider(22, range=0..40)
corner_pod_width = Slider(22, range=0..40)
districts_x = Slider(3, range=0..100)
districts_y = Slider(3, range=0..100)
district_size_a = Slider(100, range=0..1000)
district_size_b = Slider(100, range=0..1000)
district_gap = Slider(40, range=0..1000)
levels_z = Slider(15, range=0..100)
pods_between_corners = Slider(4, range=0..100)
pod_width = Slider(15, range=0..100)
pod_height = Slider(5, range=0..100)
maximum_pod_length = Slider(36, range=0..100)
horizontal_gap = Slider(2, range=0..100)
vertical_gap = Slider(5, range=0..100)
district_pitch = Addition(A=district_size_a, B=district_gap)
horizontal_bay = Addition(A=maximum_pod_length, B=horizontal_gap)
vertical_bay = Addition(A=pod_height, B=vertical_gap)

# ---- group: 01_DISTRICT NODES 2D
rectangle = Rectangle(Plane="0,0,0", XSize=district_size_a, YSize=district_size_b, Radius=0)  # -> Rectangle, Length
divide_curve = DivideCurve(Curve=rectangle.Rectangle, Count="20", Kinks=False)  # -> Points, Tangents, Parameters
cull_duplicates = CullDuplicates(Points=flatten(divide_curve.Points), Tolerance=0.1, CullMode=3)  # -> Points, Indices, Valence
base_district_nodes = Point(cull_duplicates.Points)

# ----
district_count = Multiplication(A=districts_x, B=districts_y)

# ---- group: CORNER PLANES
panel = Panel("5")
panel_2 = Panel("0")
panel_3 = Panel("10")
panel_4 = Panel("15")

# ---- group: 01_DISTRICT NODES 2D / HORIZONTAL EDGES
list_length = ListLength(List=flatten(base_district_nodes))
base_horizontal_edges = Panel(list_length)
shift_list = ShiftList(List=base_district_nodes, Shift="1", Wrap=Toggle(True))
line = Line(StartPoint=base_district_nodes, EndPoint=shift_list)

# ---- group: CORNER PLANES
merge = Merge(Data1=panel_2, Data2=panel, Data3=panel_3, Data4=panel_4)
list_item = ListItem(List=base_district_nodes, Index=merge, Wrap=True)
base_corner_planes = Plane(list_item)  # disabled

# ----
point_list = PointList(Points=base_district_nodes)  # disabled

# ---- group: BASE POD PLANES
vector_2pt = Vector2Pt(PointA=base_district_nodes, PointB=shift_list, Unitize=False)  # -> Vector, Length; disabled
pod_x_direction = UnitVector(Vector=vector_2pt.Vector)
unit_z = UnitZ(Factor=1)
cross_product = CrossProduct(VectorA=unit_z, VectorB=pod_x_direction, Unitize=False)  # -> Vector, Length
construct_plane = ConstructPlane(Origin=base_district_nodes, XAxis=pod_x_direction, YAxis=cross_product.Vector)
list_length_2 = ListLength(List=construct_plane)
base_pod_planes = Plane(construct_plane)
panel_5 = Panel(list_length_2)

# ---- group: BASE REGULAR PLANES
cull_index = CullIndex(List=base_pod_planes, Indices=merge, Wrap=True)
base_regular_planes = Plane(cull_index)
list_length_3 = ListLength(List=cull_index)
panel_6 = Panel(list_length_3)

# ---- group: 02_VERTICAL NODE GRID
series = Series(Start="0,0,0", Step=vertical_bay, Count=levels_z)
unit_z_2 = UnitZ(Factor=series)
move_r_planes = Move(Geometry=graft(base_regular_planes), Motion=unit_z_2)  # -> Geometry, Transform
move_nodes = Move(Geometry=graft(base_district_nodes), Motion=unit_z_2)  # -> Geometry, Transform
move_he = Move(Geometry=graft(line), Motion=unit_z_2)  # -> Geometry, Transform
move_c_planes = Move(Geometry=graft(base_corner_planes), Motion=unit_z_2)  # -> Geometry, Transform
list_length_4 = ListLength(List=flatten(move_nodes.Geometry))
one_district = Panel(list_length_4)

# ---- group: 03_CITY DISTRICT GRID
subtraction = Subtraction(A=levels_z, B="1")
series_x = Series(Start="0,0,0", Step=district_pitch, Count=districts_x)
series_y = Series(Start="0,0,0", Step=district_pitch, Count=districts_y)
unit_z_3 = UnitZ(Factor=vertical_bay)
series_2 = Series(Start="0", Step=vertical_bay, Count=subtraction)
unit_x = UnitX(Factor=series_x)
unit_y = UnitY(Factor=series_y)
unit_z_4 = UnitZ(Factor=series_2)
move = Move(Geometry=base_district_nodes, Motion=unit_z_3)  # -> Geometry, Transform
line_2 = Line(StartPoint=base_district_nodes, EndPoint=move.Geometry)
move_c_planes_2 = Move(Geometry=graft(move_c_planes.Geometry), Motion=unit_x)  # -> Geometry, Transform
move_nodes_2 = Move(Geometry=graft(move_nodes.Geometry), Motion=unit_x)  # -> Geometry, Transform
move_he_2 = Move(Geometry=graft(move_he.Geometry), Motion=unit_x)  # -> Geometry, Transform
move_r_planes_2 = Move(Geometry=graft(move_r_planes.Geometry), Motion=unit_x)  # -> Geometry, Transform
move_r_planes_3 = Move(Geometry=graft(move_r_planes_2.Geometry), Motion=unit_y)  # -> Geometry, Transform
move_c_planes_3 = Move(Geometry=graft(move_c_planes_2.Geometry), Motion=unit_y)  # -> Geometry, Transform
move_nodes_3 = Move(Geometry=graft(move_nodes_2.Geometry), Motion=unit_y)  # -> Geometry, Transform
move_he_3 = Move(Geometry=graft(move_he_2.Geometry), Motion=unit_y)  # -> Geometry, Transform
move_ve = Move(Geometry=graft(line_2), Motion=unit_z_4)  # -> Geometry, Transform
regular_planes = Plane(move_r_planes_3.Geometry)
corner_planes = Plane(move_c_planes_3.Geometry)
horizontal_edges = Line(move_he_3.Geometry)
city_nodes = Point(move_nodes_3.Geometry)
move_ve_2 = Move(Geometry=graft(move_ve.Geometry), Motion=unit_x)  # -> Geometry, Transform
list_length_5 = ListLength(List=flatten(move_ve.Geometry))
city_nodes_flat = Point(flatten(city_nodes))
param_viewer = ParamViewer(city_nodes)
param_viewer_2 = ParamViewer(corner_planes)
corner_planes_flat = Plane(flatten(corner_planes))
regular_planes_flat = Plane(flatten(regular_planes))
param_viewer_3 = ParamViewer(regular_planes)
move_ve_3 = Move(Geometry=graft(move_ve_2.Geometry), Motion=unit_y)  # -> Geometry, Transform
point_list_2 = PointList(Points=city_nodes_flat, Size="2")
one_disrict = Panel(list_length_5)
vertical_edges = Line(move_ve_3.Geometry)
city_grid = Merge(Data1=horizontal_edges, Data2=vertical_edges)
list_length_6 = ListLength(List=flatten(move_ve_3.Geometry))
list_length_7 = ListLength(List=flatten(city_grid))
all_disricts = Panel(list_length_6)
all_graph_edges = Panel(list_length_7)

# ---- group: CORNER POD ASSIGN
division = Division(A=corner_pod_width, B="2")
negative = Negative(Value=pod_height)
negative_2 = Negative(Value=division)
construct_domain = ConstructDomain(DomainStart=negative_2, DomainEnd=division)
construct_domain_2 = ConstructDomain(DomainStart="0", DomainEnd=corner_pod_length)
construct_domain_3 = ConstructDomain(DomainStart=negative, DomainEnd="0")
center_box = CenterBox(
    Base=corner_planes_flat,
    X=expr("x/2", construct_domain),
    Y=expr("x/2", construct_domain_2),
    Z=expr("x/2", construct_domain_3))

# ---- group: 04_NODE IDs
list_length_8 = ListLength(List=city_nodes_flat)
total_nodes = Panel(list_length_8)
series_3 = Series(Start="0", Step="1", Count=total_nodes)
number_slider = Slider(280, range=0..5400)
node_ids = Integer(series_3)
list_item_2 = ListItem(List=node_ids, Index=number_slider, Wrap=True)
list_item_3 = ListItem(List=city_nodes_flat, Index=number_slider, Wrap=True)
number_id = Panel(list_item_2)
position_id = Panel(list_item_3)

# ---- group: 04_NODE IDs / Node deBug
point = Point(list_item_3)
sphere = Sphere(Base=point, Radius="20")  # disabled

# ---- group: CITY DATABASE
merge_2 = Merge(Data1="Medical Centre", Data2="District Food Production Unit", Data3="Civic / Social Hub")

# ---- group: RANDOMIZER POD ASSIGN / REGULAR POD LENGTH
type_a = Slider(18, range=0..40)
type_b = Slider(20, range=0..40)
type_c = Slider(22, range=0..40)
type_d = Slider(24, range=0..40)
type_e = Slider(26, range=0..40)
merge_3 = Merge(Data1=type_a, Data2=type_b, Data3=type_c, Data4=type_d, Data5=type_e)  # -> flatten(Result)

# ---- group: RANDOMIZER POD ASSIGN
pod_random_seed = Slider(60, range=0..100)
construct_domain_4 = ConstructDomain(DomainStart="0", DomainEnd="5")
list_length_9 = ListLength(List=regular_planes_flat)
random = Random(Range=construct_domain_4, Number=list_length_9, Seed=pod_random_seed)
round = Round(Number=random)  # -> Nearest, Floor, Ceiling
pod_type_indices = Integer(round.Floor)
list_item_4 = ListItem(List=merge_3, Index=pod_type_indices, Wrap=True)
division_2 = Division(A=list_item_4, B="2")
division_3 = Division(A=pod_width, B="2")
rng_location = Panel(list_item_4)
negative_3 = Negative(Value=division_2)
negative_4 = Negative(Value=division_3)
construct_domain_5 = ConstructDomain(DomainStart=negative_3, DomainEnd=division_2)
construct_domain_6 = ConstructDomain(DomainStart=division_3, DomainEnd=negative_4)
construct_domain_7 = ConstructDomain(DomainStart="0", DomainEnd=pod_height)
center_box_2 = CenterBox(
    Base=regular_planes_flat,
    X=expr("x/2", construct_domain_6),
    Y=expr("x/2", construct_domain_5),
    Z=expr("x/2", construct_domain_7))

# ---- group: CITY DATABASE
merge_4 = Merge(Data1="280", Data2="550", Data3="820")  # -> flatten(Result)

# ---- group: A* Search Algorythm
start_index = Slider(280, range=0..5400)
goal_index = Slider(1936, range=0..5400)
up_factor = Slider(1.3, range=0..5400)
turn_penalty = Slider(25, range=0..5400)
horizontal_after_vertical_penalty = Slider(1854, range=0..5400)
search_nodes = Point(flatten(city_nodes))
search_edges = Curve(flatten(city_grid))
start_point = ListItem(List=search_nodes, Index=start_index, Wrap=True)
goal_point = ListItem(List=search_nodes, Index=goal_index, Wrap=True)
point_2 = Point(start_point)
point_3 = Point(goal_point)
sphere_2 = Sphere(Base=point_2, Radius="5")
sphere_3 = Sphere(Base=point_3, Radius="5")

# ---- group: CITY DATABASE
query_node = Slider(280, range=0..5400)
city_database_script = Script(
    Nodes=search_nodes,
    DistrictCount=district_count,
    LevelCount=levels_z,
    PositionsPerLevel=base_horizontal_edges,
    SpecialIDs=merge_4,
    SpecialPrograms=merge_2,
    QueryID=query_node)  # -> NodeIDs, NodePrograms, NodeCategories, NodeLabels, QueryInfo, Status; inputs Nodes: list of Point3d, DistrictCount: Int32, LevelCount: Int32, PositionsPerLevel: Int32, SpecialIDs: list of Int32, SpecialPrograms: list of String, QueryID: Int32
# ---------- city_database_script: Python ----------
# ------------------------------------------------------------
# DEFAULT OUTPUTS
# ------------------------------------------------------------

NodeIDs = []
NodePrograms = []
NodeCategories = []
NodeLabels = []
QueryInfo = ""
Status = ""


# ------------------------------------------------------------
# BASIC CHECK
# ------------------------------------------------------------

if not Nodes:

    Status = "ERROR: No nodes received."

else:

    node_count = len(Nodes)

    district_count = int(DistrictCount)
    level_count = int(LevelCount)
    positions_per_level = int(PositionsPerLevel)


    # --------------------------------------------------------
    # NODE NUMBERING STRUCTURE
    # --------------------------------------------------------

    nodes_per_position = (
        level_count
        * district_count
    )


    # --------------------------------------------------------
    # DECODE NODE ID
    # --------------------------------------------------------

    def decode_node(node_id):

        position = (
            node_id
            // nodes_per_position
        )

        remainder = (
            node_id
            % nodes_per_position
        )

        level = (
            remainder
            // district_count
        )

        district = (
            remainder
            % district_count
        )

        return (
            district,
            level,
            position
        )


    # --------------------------------------------------------
    # PROGRAMME → FUNCTIONAL CATEGORY
    # --------------------------------------------------------

    category_map = {

        # HABITATION
        "Housing":
            "Habitation",

        # FOOD
        "Major Food Production Complex":
            "Food",

        "District Food Production Unit":
            "Food",

        "Local Food / Emergency Storage":
            "Food",

        # MEDICAL
        "Central Hospital":
            "Medical / Health",

        "Medical Centre":
            "Medical / Health",

        "First Aid / Medical Station":
            "Medical / Health",

        # LIFE SUPPORT
        "Oxygen Production Unit":
            "Life Support / Atmosphere",

        "Atmosphere Processing Unit":
            "Life Support / Atmosphere",

        "Emergency Oxygen Storage":
            "Life Support / Atmosphere",

        "CO2 Scrubber / Air Treatment":
            "Life Support / Atmosphere",

        "Pressure Control System":
            "Life Support / Atmosphere",

        # WATER
        "Main Water Extraction + Storage":
            "Water",

        "Water Recycling Unit":
            "Water",

        "Water Buffer Tank":
            "Water",

        # WASTE
        "Waste / Sewage Processing Unit":
            "Waste",

        "Local Sewage Collection":
            "Waste",

        # ELECTRICAL
        "Main Power Generation Unit":
            "Electrical",

        "Electrical Substation + Battery Unit":
            "Electrical",

        "Local Battery Storage":
            "Electrical",

        # THERMAL
        "Thermal / Heat Distribution Hub":
            "Heat / Thermal",

        "Heat Exchanger":
            "Heat / Thermal",

        # INDUSTRY
        "Hydrocarbon / Refinery Complex":
            "Industry / Manufacturing",

        "Main Manufacturing / Material Processing Unit":
            "Industry / Manufacturing",

        "Manufacturing / Repair Workshop":
            "Industry / Manufacturing",

        "Local Maintenance Room":
            "Industry / Manufacturing",

        # TRANSPORT
        "Central Transport Hub":
            "Transport / Mobility",

        "Transport Interchange":
            "Transport / Mobility",

        "Vehicle / Drone Depot":
            "Transport / Mobility",

        # RESEARCH
        "Research + External Operations Centre":
            "Research / Science",

        # CIVIC
        "Civic / Social Hub":
            "Civic / Social",

        # EMERGENCY
        "Emergency / Refuge Unit":
            "Emergency / Safety",

        "Fire Suppression System":
            "Emergency / Safety",

        # LOGISTICS
        "Central Storage / Logistics Unit":
            "Logistics / Storage",

        # CONTROL
        "Central Control + Communication Unit":
            "Control / Communication",

        "Local Communication Node":
            "Control / Communication",

        # EXTERNAL
        "External Airlock Hub":
            "External Operations"
    }


    # --------------------------------------------------------
    # CREATE DEFAULT NODE DATABASE
    # --------------------------------------------------------

    NodeIDs = list(
        range(node_count)
    )

    # Every node begins as housing

    NodePrograms = [
        "Housing"
        for _ in range(node_count)
    ]

    NodeCategories = [
        "Habitation"
        for _ in range(node_count)
    ]


    # --------------------------------------------------------
    # APPLY SPECIAL PROGRAMMES
    # --------------------------------------------------------

    special_ids = []

    if SpecialIDs:
        special_ids = list(SpecialIDs)


    special_programs = []

    if SpecialPrograms:
        special_programs = list(SpecialPrograms)


    assignment_count = min(
        len(special_ids),
        len(special_programs)
    )


    invalid_ids = []


    for i in range(assignment_count):

        node_id = int(
            special_ids[i]
        )

        programme = str(
            special_programs[i]
        )


        if 0 <= node_id < node_count:

            NodePrograms[node_id] = (
                programme
            )

            NodeCategories[node_id] = (
                category_map.get(
                    programme,
                    "Other"
                )
            )

        else:

            invalid_ids.append(
                node_id
            )


    # --------------------------------------------------------
    # CREATE HUMAN-READABLE LABELS
    # --------------------------------------------------------

    for node_id in NodeIDs:

        district, level, position = (
            decode_node(node_id)
        )

        label = (
            "ID {} | D{:02d} | L{:02d} | P{:02d}"
            " | {} | {}"
        ).format(

            node_id,

            district + 1,

            level + 1,

            position + 1,

            NodePrograms[node_id],

            NodeCategories[node_id]
        )

        NodeLabels.append(
            label
        )


    # --------------------------------------------------------
    # QUERY ONE NODE
    # --------------------------------------------------------

    query_id = int(QueryID)


    if 0 <= query_id < node_count:

        district, level, position = (
            decode_node(query_id)
        )


        QueryInfo = (

            "NODE {}\n"
            "District: {}\n"
            "Level: {}\n"
            "Perimeter Position: {}\n"
            "Programme: {}\n"
            "Category: {}"

        ).format(

            query_id,

            district + 1,

            level + 1,

            position + 1,

            NodePrograms[query_id],

            NodeCategories[query_id]
        )

    else:

        QueryInfo = (
            "ERROR: Query ID outside "
            "valid node range."
        )


    # --------------------------------------------------------
    # STATUS
    # --------------------------------------------------------

    Status = (
        "METADATA CREATED | "
        + str(node_count)
        + " nodes | "
        + str(assignment_count)
        + " special programmes"
    )


    if len(special_ids) != len(special_programs):

        Status += (
            " | WARNING: SpecialIDs and "
            "SpecialPrograms have different lengths"
        )


    if invalid_ids:

        Status += (
            " | Invalid IDs: "
            + str(invalid_ids)
        )
# ---------- end city_database_script ----------
status = Panel(city_database_script.Status)
query_info = Panel(city_database_script.QueryInfo)
query_info_2 = Panel(city_database_script.NodeLabels)

# ---- group: A* Search Algorythm (continued)
a_metadata = Script(
    Nodes=search_nodes,
    Edges=search_edges,
    Start=start_point,
    Goal=goal_point,
    DistrictCount=district_count,
    LevelCount=levels_z,
    UpFactor=up_factor,
    TurnPenalty=turn_penalty,
    HorizontalAfterVerticalPenalty=horizontal_after_vertical_penalty,
    PositionsPerLevel=base_horizontal_edges,
    Programs=city_database_script.NodePrograms,
    Categories=city_database_script.NodeCategories)  # -> PathPts, PathEdges, PathIDs, PathLabels, PathPrograms, PathCategories, Cost, StartLabel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; inputs Nodes: list of Point3d, Edges: list of Curve, Start: Point3d, Goal: Point3d, UpFactor: Int32, TurnPenalty: Int32, HorizontalAfterVerticalPenalty: Int32, Programs: list of String, Categories: list of String
# ---------- a_metadata: Python ----------
import heapq
import Rhino.Geometry as rg


# ------------------------------------------------------------
# DEFAULT OUTPUTS
# ------------------------------------------------------------

PathPts = []
PathEdges = []
PathIDs = []
PathLabels = []
PathPrograms = []
PathCategories = []

Cost = None
PhysicalDistance = 0.0
VerticalDistance = 0.0
TurnCount = 0

Visited = 0
Status = ""

StartLabel = ""
GoalLabel = ""

StartNeighbors = []
StartNeighborCosts = []
StartNeighborInfo = []


# ------------------------------------------------------------
# BASIC CHECK
# ------------------------------------------------------------

if not Nodes or not Edges:

    Status = "ERROR: Nodes or Edges are empty."

elif Start is None or Goal is None:

    Status = "ERROR: Start or Goal is missing."

else:

    nodes = list(Nodes)
    edges = list(Edges)

    district_count = int(DistrictCount)
    level_count = int(LevelCount)
    positions_per_level = int(PositionsPerLevel)

    # --------------------------------------------------------
    # COST SETTINGS
    # --------------------------------------------------------

    up_factor = max(
        1.0,
        float(UpFactor)
    )

    turn_penalty = max(
        0.0,
        float(TurnPenalty)
    )

    horizontal_after_vertical_penalty = max(
        0.0,
        float(HorizontalAfterVerticalPenalty)
    )

    vertical_tolerance = 0.001


    # --------------------------------------------------------
    # NODE ID DECODER
    # --------------------------------------------------------
    #
    # Flattened node order:
    #
    # Position
    #   → Level
    #       → District
    #
    # ID =
    # position * (levels * districts)
    # + level * districts
    # + district
    #

    nodes_per_position = (
        level_count
        * district_count
    )


    def decode_node_id(node_id):

        position = (
            node_id
            // nodes_per_position
        )

        remainder = (
            node_id
            % nodes_per_position
        )

        level = (
            remainder
            // district_count
        )

        district = (
            remainder
            % district_count
        )

        return (
            district,
            level,
            position
        )


    def node_label(node_id):

        district, level, position = (
            decode_node_id(node_id)
        )

        return (
            "ID {} | D{:02d} | L{:02d} | P{:02d}"
            .format(
                node_id,
                district + 1,
                level + 1,
                position + 1
            )
        )


    # --------------------------------------------------------
    # OPTIONAL PARAMETER CHECK
    # --------------------------------------------------------

    expected_nodes = (
        district_count
        * level_count
        * positions_per_level
    )

    metadata_warning = ""

    if expected_nodes != len(nodes):

        metadata_warning = (
            " | WARNING: metadata expects "
            + str(expected_nodes)
            + " nodes but graph contains "
            + str(len(nodes))
        )


    # --------------------------------------------------------
    # POINT KEY
    # --------------------------------------------------------

    def point_key(p):

        return (
            round(p.X, 6),
            round(p.Y, 6),
            round(p.Z, 6)
        )


    # --------------------------------------------------------
    # BUILD NODE LOOKUP
    # --------------------------------------------------------

    node_lookup = {}

    for i, pt in enumerate(nodes):

        node_lookup[
            point_key(pt)
        ] = i


    # --------------------------------------------------------
    # BUILD GRAPH / ADJACENCY LIST
    # --------------------------------------------------------

    adjacency = [
        []
        for _ in range(len(nodes))
    ]

    skipped_edges = 0


    for edge in edges:

        try:

            a = edge.PointAtStart
            b = edge.PointAtEnd

            length = edge.GetLength()

        except:

            skipped_edges += 1
            continue


        a_id = node_lookup.get(
            point_key(a)
        )

        b_id = node_lookup.get(
            point_key(b)
        )


        if (
            a_id is None
            or b_id is None
        ):

            skipped_edges += 1
            continue


        # Bidirectional graph

        adjacency[a_id].append(
            (
                b_id,
                length
            )
        )

        adjacency[b_id].append(
            (
                a_id,
                length
            )
        )


    # --------------------------------------------------------
    # FIND NEAREST GRAPH NODE TO START / GOAL
    # --------------------------------------------------------

    start_id = min(
        range(len(nodes)),
        key=lambda i:
        nodes[i].DistanceTo(Start)
    )

    goal_id = min(
        range(len(nodes)),
        key=lambda i:
        nodes[i].DistanceTo(Goal)
    )


    StartLabel = node_label(
        start_id
    )

    GoalLabel = node_label(
        goal_id
    )


    # --------------------------------------------------------
    # START NODE NEIGHBOR INFORMATION
    # --------------------------------------------------------

    StartNeighbors = [
        neighbor
        for neighbor, cost
        in adjacency[start_id]
    ]


    StartNeighborCosts = [
        cost
        for neighbor, cost
        in adjacency[start_id]
    ]


    StartNeighborInfo = []

    for neighbor, cost in adjacency[start_id]:

        text = (
            node_label(neighbor)
            + " | Physical edge length = "
            + str(round(cost, 2))
            + " m"
        )

        StartNeighborInfo.append(
            text
        )


    # --------------------------------------------------------
    # MOVEMENT TYPE
    # --------------------------------------------------------
    #
    # 0 = START
    # 1 = HORIZONTAL
    # 2 = VERTICAL
    #

    def movement_type(a_id, b_id):

        a = nodes[a_id]
        b = nodes[b_id]

        dz = (
            b.Z
            - a.Z
        )

        if abs(dz) > vertical_tolerance:

            return (
                2,
                dz
            )

        return (
            1,
            dz
        )


    # --------------------------------------------------------
    # A* HEURISTIC
    # --------------------------------------------------------
    #
    # Straight-line 3D distance remains a valid
    # lower bound because all added penalties are positive.
    #

    def heuristic(node_id):

        return (
            nodes[node_id]
            .DistanceTo(
                nodes[goal_id]
            )
        )


    # --------------------------------------------------------
    # A* SEARCH WITH MOVEMENT HISTORY
    # --------------------------------------------------------
    #
    # State stores:
    #
    # (
    #   node ID,
    #   previous movement type,
    #   has vertical movement already started?
    # )
    #
    # This is necessary because reaching the same node
    # horizontally and vertically can lead to different
    # future costs.
    #

    infinity = float("inf")


    start_state = (
        start_id,
        0,
        False
    )


    g_score = {
        start_state: 0.0
    }


    came_from = {}


    open_set = []

    heapq.heappush(
        open_set,
        (
            heuristic(start_id),
            0.0,
            start_state
        )
    )


    closed_states = set()

    visited_node_ids = set()

    found = False

    goal_state = None


    while open_set:

        (
            f_current,
            g_current,
            current_state
        ) = heapq.heappop(
            open_set
        )


        current_id = (
            current_state[0]
        )

        previous_mode = (
            current_state[1]
        )

        vertical_started = (
            current_state[2]
        )


        # ----------------------------------------------------
        # IGNORE OUTDATED QUEUE ENTRIES
        # ----------------------------------------------------

        if g_current > g_score.get(
            current_state,
            infinity
        ):

            continue


        # ----------------------------------------------------
        # GOAL REACHED
        # ----------------------------------------------------

        if current_id == goal_id:

            found = True

            goal_state = (
                current_state
            )

            break


        # ----------------------------------------------------
        # SKIP ALREADY CLOSED STATE
        # ----------------------------------------------------

        if current_state in closed_states:

            continue


        closed_states.add(
            current_state
        )

        visited_node_ids.add(
            current_id
        )


        # ----------------------------------------------------
        # CHECK ALL NEIGHBORS
        # ----------------------------------------------------

        for (
            neighbor,
            physical_length
        ) in adjacency[current_id]:


            (
                move_mode,
                dz
            ) = movement_type(
                current_id,
                neighbor
            )


            # --------------------------------------------
            # BASE COST
            # --------------------------------------------
            #
            # Start from actual geometric distance.
            #

            step_cost = (
                physical_length
            )


            # --------------------------------------------
            # GRAVITY / UPWARD MOVEMENT PENALTY
            # --------------------------------------------
            #
            # Moving upward costs more.
            #
            # Example:
            #
            # 7 m upward
            # × 1.30
            # = 9.1 cost units
            #

            if dz > vertical_tolerance:

                step_cost *= (
                    up_factor
                )


            # --------------------------------------------
            # DIRECTION CHANGE / TURN PENALTY
            # --------------------------------------------
            #
            # Penalize:
            #
            # horizontal → vertical
            # vertical   → horizontal
            #
            # Do not penalize the first movement.
            #

            if (
                previous_mode != 0
                and previous_mode != move_mode
            ):

                step_cost += (
                    turn_penalty
                )


            # --------------------------------------------
            # HORIZONTAL AFTER VERTICAL PENALTY
            # --------------------------------------------
            #
            # Once vertical movement has begun,
            # strongly discourage returning to
            # horizontal movement.
            #
            # Preferred:
            #
            # H H H H H V V V V V
            #
            # Discouraged:
            #
            # H V H V H V H
            #

            if (
                vertical_started
                and move_mode == 1
            ):

                step_cost += (
                    horizontal_after_vertical_penalty
                )


            # --------------------------------------------
            # UPDATE VERTICAL PHASE
            # --------------------------------------------

            new_vertical_started = (
                vertical_started
                or move_mode == 2
            )


            # --------------------------------------------
            # CREATE NEXT STATE
            # --------------------------------------------

            neighbor_state = (
                neighbor,
                move_mode,
                new_vertical_started
            )


            # --------------------------------------------
            # CALCULATE TOTAL COST
            # --------------------------------------------

            tentative_g = (
                g_score[current_state]
                + step_cost
            )


            # --------------------------------------------
            # BETTER ROUTE FOUND
            # --------------------------------------------

            if tentative_g < g_score.get(
                neighbor_state,
                infinity
            ):

                came_from[
                    neighbor_state
                ] = current_state


                g_score[
                    neighbor_state
                ] = tentative_g


                f_score = (
                    tentative_g
                    + heuristic(
                        neighbor
                    )
                )


                heapq.heappush(
                    open_set,
                    (
                        f_score,
                        tentative_g,
                        neighbor_state
                    )
                )


    # --------------------------------------------------------
    # VISITED NODES
    # --------------------------------------------------------

    Visited = len(
        visited_node_ids
    )


    # --------------------------------------------------------
    # RECONSTRUCT PATH
    # --------------------------------------------------------

    if found:

        # ----------------------------------------------------
        # RECONSTRUCT STATE PATH
        # ----------------------------------------------------

        state_path = [
            goal_state
        ]

        current_state = (
            goal_state
        )


        while (
            current_state
            != start_state
        ):

            current_state = (
                came_from[
                    current_state
                ]
            )

            state_path.append(
                current_state
            )


        state_path.reverse()


        # ----------------------------------------------------
        # EXTRACT NODE IDs
        # ----------------------------------------------------

        path_ids = [
            state[0]
            for state in state_path
        ]


        # ----------------------------------------------------
        # PATH IDs
        # ----------------------------------------------------

        PathIDs = (
            path_ids
        )


        # ----------------------------------------------------
        # PATH PROGRAMMES
        # ----------------------------------------------------

        if Programs:

            PathPrograms = [
                Programs[i]
                for i in path_ids
            ]

        else:

            PathPrograms = []


        # ----------------------------------------------------
        # PATH CATEGORIES
        # ----------------------------------------------------

        if Categories:

            PathCategories = [
                Categories[i]
                for i in path_ids
            ]

        else:

            PathCategories = []


        # ----------------------------------------------------
        # HUMAN-READABLE LABELS
        # ----------------------------------------------------

        PathLabels = [
            node_label(i)
            for i in path_ids
        ]


        # ----------------------------------------------------
        # PATH POINTS
        # ----------------------------------------------------

        PathPts = [
            nodes[i]
            for i in path_ids
        ]


        # ----------------------------------------------------
        # PATH EDGES
        # ----------------------------------------------------

        path_edges = []

        for i in range(
            len(PathPts) - 1
        ):

            line = rg.Line(
                PathPts[i],
                PathPts[i + 1]
            )

            path_edges.append(
                line
            )


        PathEdges = (
            path_edges
        )


        # ----------------------------------------------------
        # WEIGHTED TOTAL COST
        # ----------------------------------------------------

        Cost = (
            g_score[
                goal_state
            ]
        )


        # ----------------------------------------------------
        # PHYSICAL DISTANCE
        # ----------------------------------------------------

        PhysicalDistance = 0.0

        for i in range(
            len(PathPts) - 1
        ):

            PhysicalDistance += (
                PathPts[i]
                .DistanceTo(
                    PathPts[i + 1]
                )
            )


        # ----------------------------------------------------
        # VERTICAL DISTANCE
        # ----------------------------------------------------

        VerticalDistance = 0.0

        for i in range(
            len(PathPts) - 1
        ):

            dz = abs(
                PathPts[i + 1].Z
                - PathPts[i].Z
            )

            if (
                dz
                > vertical_tolerance
            ):

                VerticalDistance += (
                    dz
                )


        # ----------------------------------------------------
        # COUNT DIRECTION CHANGES
        # ----------------------------------------------------

        movement_modes = []

        for i in range(
            len(path_ids) - 1
        ):

            mode, dz = (
                movement_type(
                    path_ids[i],
                    path_ids[i + 1]
                )
            )

            movement_modes.append(
                mode
            )


        TurnCount = 0


        for i in range(
            1,
            len(movement_modes)
        ):

            if (
                movement_modes[i]
                != movement_modes[i - 1]
            ):

                TurnCount += 1


        # ----------------------------------------------------
        # STATUS
        # ----------------------------------------------------

        Status = (
            "PATH FOUND"
            + " | "
            + str(len(path_ids))
            + " nodes"
            + " | Physical distance = "
            + str(
                round(
                    PhysicalDistance,
                    2
                )
            )
            + " m"
            + " | Weighted cost = "
            + str(
                round(
                    Cost,
                    2
                )
            )
            + " | Turns = "
            + str(
                TurnCount
            )
            + " | Vertical distance = "
            + str(
                round(
                    VerticalDistance,
                    2
                )
            )
            + " m"
            + " | Visited = "
            + str(
                Visited
            )
            + " | Skipped edges = "
            + str(
                skipped_edges
            )
            + metadata_warning
        )


    else:

        Status = (
            "NO PATH FOUND. "
            "Start and Goal may belong to disconnected districts."
            + " | Visited = "
            + str(
                Visited
            )
            + " | Skipped edges = "
            + str(
                skipped_edges
            )
            + metadata_warning
        )
# ---------- end a_metadata ----------
custom_preview = CustomPreview(Geometry=a_metadata.PathEdges, Material=ColourSwatch(SwatchColor=RGB(0, 255, 17)))
path_programs = Panel(a_metadata.PathPrograms)
path_categories = Panel(a_metadata.PathCategories)
cost_m = Panel(a_metadata.Cost)
start_label = Panel(a_metadata.StartLabel)
goal_label = Panel(a_metadata.GoalLabel)
start_neighbors = Panel(a_metadata.StartNeighbors)
start_neighbor_costs = Panel(a_metadata.StartNeighborCosts)
start_neighbor_info = Panel(a_metadata.StartNeighborInfo)
path_labels = Panel(a_metadata.PathLabels)
visited = Panel(a_metadata.Visited)
status_2 = Panel(a_metadata.Status)
path_ids = Panel(a_metadata.PathIDs)
