# Grasshopper definition GRID.ghx (Grasshopper 1.0.8)

# ---- group: 00_GLOBAL INPUTS
districts_x = Slider(2, range=0..100)
districts_y = Slider(2, range=0..100)
district_size_a = Slider(190, range=0..1000)
district_size_b = Slider(190, range=0..1000)
district_gap = Slider(40, range=0..1000)
levels_z = Slider(30, range=0..100)
pods_between_corners = Slider(4, range=0..100)
pod_width = Slider(5, range=0..100)
pod_height = Slider(5, range=0..100)
maximum_pod_length = Slider(30, range=0..100)
horizontal_gap = Slider(2, range=0..100)
vertical_gap = Slider(2, range=0..100)
horizontal_bay = Addition(A=maximum_pod_length, B=horizontal_gap)
vertical_bay = Addition(A=pod_height, B=vertical_gap)

# ---- group: 01_DISTRICT NODES 2D
rectangle = Rectangle(Plane="0,0,0", XSize=district_size_a, YSize=district_size_b, Radius=0)  # -> Rectangle, Length
explode = Explode(Curve=rectangle.Rectangle, Recursive=True)  # -> Segments, Vertices
divide_curve = DivideCurve(Curve=explode.Segments, Count="5", Kinks=False)  # -> Points, Tangents, Parameters
cull_duplicates = CullDuplicates(Points=flatten(divide_curve.Points), Tolerance=0.1, CullMode=3)  # -> Points, Indices, Valence

# ----
district_pitch = Addition(A=district_size_a, B=district_gap)

# ---- group: 02_VERTICAL NODE GRID
series = Series(Start="0,0,0", Step=vertical_bay, Count=levels_z)
unit_z = UnitZ(Factor=series)
move_points = Move(Geometry=graft(cull_duplicates.Points), Motion=unit_z)  # -> Geometry, Transform
move_rect = Move(Geometry=graft(rectangle.Rectangle), Motion=unit_z)  # -> Geometry, Transform

# ---- group: 03_CITY DISTRICT GRID
series_x = Series(Start="0,0,0", Step=district_pitch, Count=districts_x)
series_y = Series(Start="0,0,0", Step=district_pitch, Count=districts_y)
unit_x = UnitX(Factor=series_x)
unit_y = UnitY(Factor=series_y)
move = Move(Geometry=graft(move_points.Geometry), Motion=unit_x)  # -> Geometry, Transform
move_2 = Move(Geometry=graft(move_rect.Geometry), Motion=unit_x)  # -> Geometry, Transform
move_3 = Move(Geometry=graft(move.Geometry), Motion=unit_y)  # -> Geometry, Transform
move_4 = Move(Geometry=graft(move_2.Geometry), Motion=unit_y)  # -> Geometry, Transform

# ----
city_nodes = Point(move_3.Geometry)
city_nodes_flat = Point(flatten(city_nodes))
list_length = ListLength(List=city_nodes_flat)
panel = Panel(list_length)
series_2 = Series(Start="0", Step="1", Count=panel)
node_ids = Integer(series_2)
list_item = ListItem(Index=0, Wrap=True)
list_item_2 = ListItem(Index=0, Wrap=True)
