# Grasshopper definition GRID2.ghx (Grasshopper 1.0.8)

# ---- group: 00_GLOBAL INPUTS
districts_x = Slider(3, range=0..100)
districts_y = Slider(3, range=0..100)
district_size_a = Slider(190, range=0..1000)
district_size_b = Slider(190, range=0..1000)
district_gap = Slider(40, range=0..1000)
levels_z = Slider(30, range=0..100)
pods_between_corners = Slider(4, range=0..100)
pod_width = Slider(10, range=0..100)
pod_height = Slider(5, range=0..100)
maximum_pod_length = Slider(36, range=0..100)
horizontal_gap = Slider(2, range=0..100)
vertical_gap = Slider(2, range=0..100)
horizontal_bay = Addition(A=maximum_pod_length, B=horizontal_gap)
vertical_bay = Addition(A=pod_height, B=vertical_gap)

# ---- group: 01_DISTRICT NODES 2D
rectangle = Rectangle(Plane="0,0,0", XSize=district_size_a, YSize=district_size_b, Radius=0)  # -> Rectangle, Length
divide_curve = DivideCurve(Curve=rectangle.Rectangle, Count="20", Kinks=False)  # -> Points, Tangents, Parameters
cull_duplicates = CullDuplicates(Points=flatten(divide_curve.Points), Tolerance=0.1, CullMode=3)  # -> Points, Indices, Valence
base_district_nodes = Point(cull_duplicates.Points)

# ----
district_pitch = Addition(A=district_size_a, B=district_gap)

# ---- group: HORIZONTAL EDGES
list_length = ListLength(List=flatten(base_district_nodes))
base_horizontal_edges = Panel(list_length)
shift_list = ShiftList(List=base_district_nodes, Shift="1", Wrap=Toggle(True))
line = Line(StartPoint=base_district_nodes, EndPoint=shift_list)

# ---- group: BASE POD PLANES
vector_2pt = Vector2Pt(PointA=base_district_nodes, PointB=shift_list, Unitize=False)  # -> Vector, Length
pod_x_direction = UnitVector(Vector=vector_2pt.Vector)
unit_z = UnitZ(Factor=1)
cross_product = CrossProduct(VectorA=unit_z, VectorB=pod_x_direction, Unitize=False)  # -> Vector, Length
construct_plane = ConstructPlane(Origin=base_district_nodes, XAxis=pod_x_direction, YAxis=cross_product.Vector)
list_length_2 = ListLength(List=construct_plane)
base_pod_planes = Plane(construct_plane)
panel = Panel(list_length_2)

# ---- group: 02_VERTICAL NODE GRID
series = Series(Start="0,0,0", Step=vertical_bay, Count=levels_z)
unit_z_2 = UnitZ(Factor=series)
move_planes = Move(Geometry=graft(base_pod_planes), Motion=unit_z_2)  # -> Geometry, Transform
move_nodes = Move(Geometry=graft(base_district_nodes), Motion=unit_z_2)  # -> Geometry, Transform
move_he = Move(Geometry=graft(line), Motion=unit_z_2)  # -> Geometry, Transform

# ---- group: 03_CITY DISTRICT GRID
subtraction = Subtraction(A=levels_z, B="1")
series_x = Series(Start="0,0,0", Step=district_pitch, Count=districts_x)
series_y = Series(Start="0,0,0", Step=district_pitch, Count=districts_y)
unit_z_3 = UnitZ(Factor=vertical_bay)
series_2 = Series(Start="0", Step=vertical_bay, Count=subtraction)
unit_x = UnitX(Factor=series_x)
unit_y = UnitY(Factor=series_y)
unit_z_4 = UnitZ(Factor=series_2)
move = Move(Geometry=base_district_nodes, Motion=unit_z_3)  # -> Geometry, Transform
line_2 = Line(StartPoint=base_district_nodes, EndPoint=move.Geometry)
move_nodes_2 = Move(Geometry=graft(move_nodes.Geometry), Motion=unit_x)  # -> Geometry, Transform
move_he_2 = Move(Geometry=graft(move_he.Geometry), Motion=unit_x)  # -> Geometry, Transform
move_planes_2 = Move(Geometry=graft(move_planes.Geometry), Motion=unit_x)  # -> Geometry, Transform
move_planes_3 = Move(Geometry=graft(move_planes_2.Geometry), Motion=unit_y)  # -> Geometry, Transform
move_nodes_3 = Move(Geometry=graft(move_nodes_2.Geometry), Motion=unit_y)  # -> Geometry, Transform
move_he_3 = Move(Geometry=graft(move_he_2.Geometry), Motion=unit_y)  # -> Geometry, Transform
move_ve = Move(Geometry=graft(line_2), Motion=unit_z_4)  # -> Geometry, Transform
horizontal_edges = Line(move_he_3.Geometry)
city_nodes = Point(move_nodes_3.Geometry)
move_ve_2 = Move(Geometry=graft(move_ve.Geometry), Motion=unit_x)  # -> Geometry, Transform
list_length_3 = ListLength(List=flatten(move_ve.Geometry))
city_nodes_flat = Point(flatten(city_nodes))
param_viewer = ParamViewer(city_nodes)
move_ve_3 = Move(Geometry=graft(move_ve_2.Geometry), Motion=unit_y)  # -> Geometry, Transform
one_disrict = Panel(list_length_3)
vertical_edges = Line(move_ve_3.Geometry)
city_grid = Merge(Data1=horizontal_edges, Data2=vertical_edges)
list_length_4 = ListLength(List=flatten(move_ve_3.Geometry))
list_length_5 = ListLength(List=flatten(city_grid))
all_disricts = Panel(list_length_4)
all_graph_edges = Panel(list_length_5)

# ----
list_length_6 = ListLength(List=flatten(move_nodes.Geometry))
one_district = Panel(list_length_6)

# ---- group: 04_NODE IDs
list_length_7 = ListLength(List=city_nodes_flat)
total_nodes = Panel(list_length_7)
series_3 = Series(Start="0", Step="1", Count=total_nodes)
number_slider = Slider(5399, range=0..5400)
node_ids = Integer(series_3)
list_item = ListItem(List=node_ids, Index=number_slider, Wrap=True)
list_item_2 = ListItem(List=city_nodes_flat, Index=number_slider, Wrap=True)
number_id = Panel(list_item)
position_id = Panel(list_item_2)

# ----
pod_planes = Plane(move_planes_3.Geometry)
panel_2 = Panel("0")
param_viewer_2 = ParamViewer(pod_planes)
pod_planes_flat = Plane(flatten(pod_planes))

# ---- group: POD LENGTH TYPES
type_d = Slider(34, range=0..40)
type_a = Slider(28, range=0..40)
type_b = Slider(30, range=0..40)
type_c = Slider(32, range=0..40)
type_e = Slider(36, range=0..40)
merge = Merge(Data1=type_a, Data2=type_b, Data3=type_c, Data4=type_d, Data5=type_e)  # -> flatten(Result)

# ---- group: 04_NODE IDs / Node deBug
point = Point(list_item_2)
sphere = Sphere(Base=point, Radius="20")  # disabled

# ---- group: POD ASSIGN
pod_random_seed = Slider(60, range=0..100)
construct_domain = ConstructDomain(DomainStart="0", DomainEnd="5")
list_length_8 = ListLength(List=pod_planes_flat)
random = Random(Range=construct_domain, Number=list_length_8, Seed=pod_random_seed)
round = Round(Number=random)  # -> Nearest, Floor, Ceiling
pod_type_indices = Integer(round.Floor)
list_item_3 = ListItem(List=merge, Index=pod_type_indices, Wrap=True)
division = Division(A=merge, B="2")
division_2 = Division(A=pod_width, B="2")
rng_location = Panel(list_item_3)
negative = Negative(Value=division)
negative_2 = Negative(Value=division_2)
construct_domain_2 = ConstructDomain(DomainStart=negative, DomainEnd=division)
construct_domain_3 = ConstructDomain(DomainStart=division_2, DomainEnd=negative_2)
construct_domain_4 = ConstructDomain(DomainStart="0", DomainEnd=pod_height)
center_box = CenterBox(Base=pod_planes_flat, X=construct_domain_3, Y=construct_domain_2, Z=construct_domain_4)
