# Grasshopper definition GRID4.ghx (Grasshopper 1.0.8)

# ---- group: 00_GLOBAL INPUTS
corner_pod_length = Slider(22, range=0..40)
corner_pod_width = Slider(22, range=0..40)
districts_x = Slider(3, range=0..100)
districts_y = Slider(3, range=0..100)
district_size_a = Slider(100, range=0..1000)
district_size_b = Slider(100, range=0..1000)
district_gap = Slider(40, range=0..1000)
levels_z = Slider(15, range=0..100)
pods_between_corners = Slider(4, range=0..100)
pod_width = Slider(15, range=0..100)
pod_height = Slider(5, range=0..100)
maximum_pod_length = Slider(36, range=0..100)
horizontal_gap = Slider(2, range=0..100)
vertical_gap = Slider(5, range=0..100)
district_pitch = Addition(A=district_size_a, B=district_gap)
horizontal_bay = Addition(A=maximum_pod_length, B=horizontal_gap)
vertical_bay = Addition(A=pod_height, B=vertical_gap)

# ---- group: 01_DISTRICT NODES 2D
rectangle = Rectangle(Plane="0,0,0", XSize=district_size_a, YSize=district_size_b, Radius=0)  # -> Rectangle, Length
divide_curve = DivideCurve(Curve=rectangle.Rectangle, Count="20", Kinks=False)  # -> Points, Tangents, Parameters
cull_duplicates = CullDuplicates(Points=flatten(divide_curve.Points), Tolerance=0.1, CullMode=3)  # -> Points, Indices, Valence
base_district_nodes = Point(cull_duplicates.Points)

# ----
district_count = Multiplication(A=districts_x, B=districts_y)

# ---- group: CORNER PLANES
panel = Panel("5")
panel_2 = Panel("0")
panel_3 = Panel("10")
panel_4 = Panel("15")

# ---- group: 01_DISTRICT NODES 2D / HORIZONTAL EDGES
list_length = ListLength(List=flatten(base_district_nodes))
base_horizontal_edges = Panel(list_length)
shift_list = ShiftList(List=base_district_nodes, Shift="1", Wrap=Toggle(True))
line = Line(StartPoint=base_district_nodes, EndPoint=shift_list)

# ---- group: CORNER PLANES
merge = Merge(Data1=panel_2, Data2=panel, Data3=panel_3, Data4=panel_4)
list_item = ListItem(List=base_district_nodes, Index=merge, Wrap=True)
base_corner_planes = Plane(list_item)  # disabled

# ----
point_list = PointList(Points=base_district_nodes)  # disabled

# ---- group: BASE POD PLANES
vector_2pt = Vector2Pt(PointA=base_district_nodes, PointB=shift_list, Unitize=False)  # -> Vector, Length; disabled
pod_x_direction = UnitVector(Vector=vector_2pt.Vector)
unit_z = UnitZ(Factor=1)
cross_product = CrossProduct(VectorA=unit_z, VectorB=pod_x_direction, Unitize=False)  # -> Vector, Length
construct_plane = ConstructPlane(Origin=base_district_nodes, XAxis=pod_x_direction, YAxis=cross_product.Vector)
list_length_2 = ListLength(List=construct_plane)
base_pod_planes = Plane(construct_plane)
panel_5 = Panel(list_length_2)

# ---- group: BASE REGULAR PLANES
cull_index = CullIndex(List=base_pod_planes, Indices=merge, Wrap=True)
base_regular_planes = Plane(cull_index)
list_length_3 = ListLength(List=cull_index)
panel_6 = Panel(list_length_3)

# ---- group: 02_VERTICAL NODE GRID
series = Series(Start="0,0,0", Step=vertical_bay, Count=levels_z)
unit_z_2 = UnitZ(Factor=series)
move_r_planes = Move(Geometry=graft(base_regular_planes), Motion=unit_z_2)  # -> Geometry, Transform
move_nodes = Move(Geometry=graft(base_district_nodes), Motion=unit_z_2)  # -> Geometry, Transform
move_he = Move(Geometry=graft(line), Motion=unit_z_2)  # -> Geometry, Transform
move_c_planes = Move(Geometry=graft(base_corner_planes), Motion=unit_z_2)  # -> Geometry, Transform
list_length_4 = ListLength(List=flatten(move_nodes.Geometry))
one_district = Panel(list_length_4)

# ---- group: RANDOMIZER POD ASSIGN / REGULAR POD LENGTH
type_a = Slider(18, range=0..40)
type_b = Slider(20, range=0..40)
type_c = Slider(22, range=0..40)
type_d = Slider(24, range=0..40)
type_e = Slider(26, range=0..40)
merge_2 = Merge(Data1=type_a, Data2=type_b, Data3=type_c, Data4=type_d, Data5=type_e)  # -> flatten(Result)

# ---- group: 03_CITY DISTRICT GRID
subtraction = Subtraction(A=levels_z, B="1")
series_x = Series(Start="0,0,0", Step=district_pitch, Count=districts_x)
series_y = Series(Start="0,0,0", Step=district_pitch, Count=districts_y)
unit_z_3 = UnitZ(Factor=vertical_bay)
series_2 = Series(Start="0", Step=vertical_bay, Count=subtraction)
unit_x = UnitX(Factor=series_x)
unit_y = UnitY(Factor=series_y)
unit_z_4 = UnitZ(Factor=series_2)
move = Move(Geometry=base_district_nodes, Motion=unit_z_3)  # -> Geometry, Transform
line_2 = Line(StartPoint=base_district_nodes, EndPoint=move.Geometry)
move_c_planes_2 = Move(Geometry=graft(move_c_planes.Geometry), Motion=unit_x)  # -> Geometry, Transform
move_nodes_2 = Move(Geometry=graft(move_nodes.Geometry), Motion=unit_x)  # -> Geometry, Transform
move_he_2 = Move(Geometry=graft(move_he.Geometry), Motion=unit_x)  # -> Geometry, Transform
move_r_planes_2 = Move(Geometry=graft(move_r_planes.Geometry), Motion=unit_x)  # -> Geometry, Transform
move_r_planes_3 = Move(Geometry=graft(move_r_planes_2.Geometry), Motion=unit_y)  # -> Geometry, Transform
move_c_planes_3 = Move(Geometry=graft(move_c_planes_2.Geometry), Motion=unit_y)  # -> Geometry, Transform
move_nodes_3 = Move(Geometry=graft(move_nodes_2.Geometry), Motion=unit_y)  # -> Geometry, Transform
move_he_3 = Move(Geometry=graft(move_he_2.Geometry), Motion=unit_y)  # -> Geometry, Transform
move_ve = Move(Geometry=graft(line_2), Motion=unit_z_4)  # -> Geometry, Transform
regular_planes = Plane(move_r_planes_3.Geometry)
corner_planes = Plane(move_c_planes_3.Geometry)
horizontal_edges = Line(move_he_3.Geometry)
city_nodes = Point(move_nodes_3.Geometry)
move_ve_2 = Move(Geometry=graft(move_ve.Geometry), Motion=unit_x)  # -> Geometry, Transform
list_length_5 = ListLength(List=flatten(move_ve.Geometry))
param_viewer = ParamViewer(city_nodes)
param_viewer_2 = ParamViewer(corner_planes)
city_nodes_flat = Point(flatten(city_nodes))
corner_planes_flat = Plane(flatten(corner_planes))
regular_planes_flat = Plane(flatten(regular_planes))
param_viewer_3 = ParamViewer(regular_planes)
move_ve_3 = Move(Geometry=graft(move_ve_2.Geometry), Motion=unit_y)  # -> Geometry, Transform
point_list_2 = PointList(Points=city_nodes_flat, Size="2")
one_disrict = Panel(list_length_5)
vertical_edges = Line(move_ve_3.Geometry)
list_length_6 = ListLength(List=flatten(move_ve_3.Geometry))
all_disricts = Panel(list_length_6)

# ---- group: CORNER POD ASSIGN
division = Division(A=corner_pod_width, B="2")
negative = Negative(Value=pod_height)
negative_2 = Negative(Value=division)
construct_domain = ConstructDomain(DomainStart=negative_2, DomainEnd=division)
construct_domain_2 = ConstructDomain(DomainStart="0", DomainEnd=corner_pod_length)
construct_domain_3 = ConstructDomain(DomainStart=negative, DomainEnd="0")
center_box = CenterBox(
    Base=corner_planes_flat,
    X=expr("x/2", construct_domain),
    Y=expr("x/2", construct_domain_2),
    Z=expr("x/2", construct_domain_3))

# ---- group: 04_NODE IDs
list_length_7 = ListLength(List=city_nodes_flat)
total_nodes = Panel(list_length_7)
series_3 = Series(Start="0", Step="1", Count=total_nodes)
number_slider = Slider(280, range=0..5400)
node_ids = Integer(series_3)
list_item_2 = ListItem(List=node_ids, Index=number_slider, Wrap=True)
list_item_3 = ListItem(List=city_nodes_flat, Index=number_slider, Wrap=True)
number_id = Panel(list_item_2)
position_id = Panel(list_item_3)

# ---- group: 04_NODE IDs / Node deBug
point = Point(list_item_3)
sphere = Sphere(Base=point, Radius="20")  # disabled

# ---- group: INTER-DISTRICT EDGES
connector_every = Slider(5, range=0..100)
inter_district_connectors = Script(
    Nodes=city_nodes_flat,
    DistrictCount=district_count,
    LevelCount=levels_z,
    PositionsPerLevel=base_horizontal_edges,
    ConnectorEvery=connector_every)  # -> BridgeEdges, BridgeInfo, BridgeStarts, BridgeEnds, DistrictPairs, BridgeCount, Status; inputs Nodes: list of Point3d, DistrictCount: Int32, LevelCount: Int32, PositionsPerLevel: Int32, ConnectorEvery: Int32
# ---------- inter_district_connectors: Python ----------
# ------------------------------------------------------------
# INTER-DISTRICT CONNECTORS
# ------------------------------------------------------------
# Finds adjacent districts and selects the closest pair
# of graph nodes between them at regular vertical intervals.
#
# Python outputs POINTS only.
# Native Grasshopper Line component should create the actual
# bridge geometry:
#
# BridgeStarts -> Line A
# BridgeEnds   -> Line B
# ------------------------------------------------------------


# ------------------------------------------------------------
# DEFAULT OUTPUTS
# ------------------------------------------------------------

BridgeStarts = []
BridgeEnds = []

BridgeInfo = []
DistrictPairs = []

BridgeCount = 0
Status = ""


# ------------------------------------------------------------
# BASIC CHECK
# ------------------------------------------------------------

if not Nodes:

    Status = "ERROR: No nodes received."

else:

    nodes = list(Nodes)

    district_count = int(DistrictCount)
    level_count = int(LevelCount)
    positions_per_level = int(PositionsPerLevel)

    connector_every = max(
        1,
        int(ConnectorEvery)
    )


    # --------------------------------------------------------
    # NODE NUMBERING STRUCTURE
    # --------------------------------------------------------
    #
    # Your flattened node order is:
    #
    # Position
    #   -> Level
    #       -> District
    #
    # Formula:
    #
    # ID =
    # Position * (LevelCount * DistrictCount)
    # + Level * DistrictCount
    # + District
    #
    # --------------------------------------------------------

    nodes_per_position = (
        level_count
        * district_count
    )


    # --------------------------------------------------------
    # DECODE NODE ID
    # --------------------------------------------------------

    def decode_node(node_id):

        position = (
            node_id
            // nodes_per_position
        )

        remainder = (
            node_id
            % nodes_per_position
        )

        level = (
            remainder
            // district_count
        )

        district = (
            remainder
            % district_count
        )

        return (
            district,
            level,
            position
        )


    # --------------------------------------------------------
    # CHECK EXPECTED NODE COUNT
    # --------------------------------------------------------

    expected_nodes = (
        district_count
        * level_count
        * positions_per_level
    )

    node_warning = ""

    if expected_nodes != len(nodes):

        node_warning = (
            " | WARNING: expected "
            + str(expected_nodes)
            + " nodes but received "
            + str(len(nodes))
        )


    # --------------------------------------------------------
    # GROUP NODE IDs BY DISTRICT
    # --------------------------------------------------------

    district_nodes = {}

    for d in range(district_count):

        district_nodes[d] = []


    for node_id in range(len(nodes)):

        district, level, position = (
            decode_node(node_id)
        )

        if district in district_nodes:

            district_nodes[
                district
            ].append(
                node_id
            )


    # --------------------------------------------------------
    # CALCULATE DISTRICT CENTRES
    # --------------------------------------------------------
    #
    # We calculate the average XYZ position of all nodes
    # belonging to each district.
    #
    # These centres are used to determine which districts
    # are immediate neighbours.
    # --------------------------------------------------------

    district_centres = {}


    for district in range(
        district_count
    ):

        ids = district_nodes[
            district
        ]

        if not ids:

            continue


        x_total = 0.0
        y_total = 0.0
        z_total = 0.0


        for node_id in ids:

            pt = nodes[
                node_id
            ]

            x_total += pt.X
            y_total += pt.Y
            z_total += pt.Z


        count = float(
            len(ids)
        )


        centre_x = (
            x_total
            / count
        )

        centre_y = (
            y_total
            / count
        )

        centre_z = (
            z_total
            / count
        )


        # Store centre simply as XYZ tuple.
        # No Rhino geometry output is required here.

        district_centres[
            district
        ] = (
            centre_x,
            centre_y,
            centre_z
        )


    # --------------------------------------------------------
    # 3D DISTANCE FUNCTION
    # --------------------------------------------------------

    def xyz_distance(a, b):

        dx = (
            a[0]
            - b[0]
        )

        dy = (
            a[1]
            - b[1]
        )

        dz = (
            a[2]
            - b[2]
        )

        return (
            dx * dx
            + dy * dy
            + dz * dz
        ) ** 0.5


    # --------------------------------------------------------
    # CALCULATE DISTANCES BETWEEN ALL DISTRICT CENTRES
    # --------------------------------------------------------

    pair_distances = []

    districts = list(
        district_centres.keys()
    )


    for i in range(
        len(districts)
    ):

        for j in range(
            i + 1,
            len(districts)
        ):

            district_a = (
                districts[i]
            )

            district_b = (
                districts[j]
            )


            centre_a = (
                district_centres[
                    district_a
                ]
            )

            centre_b = (
                district_centres[
                    district_b
                ]
            )


            distance = (
                xyz_distance(
                    centre_a,
                    centre_b
                )
            )


            pair_distances.append(
                (
                    distance,
                    district_a,
                    district_b
                )
            )


    # --------------------------------------------------------
    # FIND THE NEAREST DISTRICT SPACING
    # --------------------------------------------------------
    #
    # For a regular 3x3 grid:
    #
    # direct X/Y neighbours have the shortest
    # centre-to-centre distance.
    #
    # diagonal districts are farther away.
    #
    # --------------------------------------------------------

    positive_distances = [
        item[0]
        for item
        in pair_distances
        if item[0] > 0
    ]


    if positive_distances:

        nearest_spacing = min(
            positive_distances
        )

    else:

        nearest_spacing = 0.0


    # --------------------------------------------------------
    # ADJACENCY TOLERANCE
    # --------------------------------------------------------
    #
    # Allow 5% variation.
    #
    # This should still work later when the city becomes
    # slightly irregular.
    #
    # --------------------------------------------------------

    adjacency_limit = (
        nearest_spacing
        * 1.05
    )


    # --------------------------------------------------------
    # FIND ADJACENT DISTRICT PAIRS
    # --------------------------------------------------------

    adjacent_pairs = []


    for (
        distance,
        district_a,
        district_b
    ) in pair_distances:

        if (
            nearest_spacing > 0
            and distance
            <= adjacency_limit
        ):

            adjacent_pairs.append(
                (
                    district_a,
                    district_b
                )
            )


    # --------------------------------------------------------
    # HUMAN-READABLE DISTRICT PAIRS
    # --------------------------------------------------------

    DistrictPairs = []


    for (
        district_a,
        district_b
    ) in adjacent_pairs:

        DistrictPairs.append(
            "{} <-> {}".format(
                district_a + 1,
                district_b + 1
            )
        )


    # --------------------------------------------------------
    # CREATE CONNECTOR LEVELS
    # --------------------------------------------------------
    #
    # Example:
    #
    # LevelCount = 15
    # ConnectorEvery = 5
    #
    # Internal levels:
    #
    # 0
    # 5
    # 10
    #
    # Displayed as:
    #
    # Level 1
    # Level 6
    # Level 11
    #
    # --------------------------------------------------------

    connector_levels = list(
        range(
            0,
            level_count,
            connector_every
        )
    )


    # --------------------------------------------------------
    # PREPARE OUTPUT LISTS
    # --------------------------------------------------------

    bridge_starts = []
    bridge_ends = []

    bridge_info = []


    # --------------------------------------------------------
    # PROCESS EACH ADJACENT DISTRICT PAIR
    # --------------------------------------------------------

    for (
        district_a,
        district_b
    ) in adjacent_pairs:


        # ----------------------------------------------------
        # PROCESS EACH CONNECTOR LEVEL
        # ----------------------------------------------------

        for level in connector_levels:


            # ------------------------------------------------
            # FIND ALL NODES IN DISTRICT A ON THIS LEVEL
            # ------------------------------------------------

            candidates_a = []


            for node_id in district_nodes[
                district_a
            ]:

                (
                    d,
                    l,
                    p
                ) = decode_node(
                    node_id
                )

                if l == level:

                    candidates_a.append(
                        node_id
                    )


            # ------------------------------------------------
            # FIND ALL NODES IN DISTRICT B ON THIS LEVEL
            # ------------------------------------------------

            candidates_b = []


            for node_id in district_nodes[
                district_b
            ]:

                (
                    d,
                    l,
                    p
                ) = decode_node(
                    node_id
                )

                if l == level:

                    candidates_b.append(
                        node_id
                    )


            # ------------------------------------------------
            # SKIP IF EITHER DISTRICT HAS NO CANDIDATES
            # ------------------------------------------------

            if (
                not candidates_a
                or not candidates_b
            ):

                continue


            # ------------------------------------------------
            # FIND CLOSEST NODE PAIR BETWEEN THE DISTRICTS
            # ------------------------------------------------

            best_a = None
            best_b = None

            best_distance = None


            for a_id in candidates_a:

                point_a = (
                    nodes[
                        a_id
                    ]
                )


                for b_id in candidates_b:

                    point_b = (
                        nodes[
                            b_id
                        ]
                    )


                    distance = (
                        point_a.DistanceTo(
                            point_b
                        )
                    )


                    if (
                        best_distance is None
                        or distance
                        < best_distance
                    ):

                        best_distance = (
                            distance
                        )

                        best_a = (
                            a_id
                        )

                        best_b = (
                            b_id
                        )


            # ------------------------------------------------
            # STORE BRIDGE ENDPOINTS
            # ------------------------------------------------
            #
            # IMPORTANT:
            #
            # We output Point3d objects only.
            #
            # Native Grasshopper will create the actual lines.
            #
            # ------------------------------------------------

            if (
                best_a is not None
                and best_b is not None
            ):

                bridge_starts.append(
                    nodes[
                        best_a
                    ]
                )

                bridge_ends.append(
                    nodes[
                        best_b
                    ]
                )


                # --------------------------------------------
                # DEBUG INFORMATION
                # --------------------------------------------

                info = (
                    "D{} -> D{}"
                    " | Level {}"
                    " | Node {} -> {}"
                    " | Length = {} m"
                ).format(

                    district_a + 1,
                    district_b + 1,

                    level + 1,

                    best_a,
                    best_b,

                    round(
                        best_distance,
                        2
                    )
                )


                bridge_info.append(
                    info
                )


    # --------------------------------------------------------
    # OUTPUT
    # --------------------------------------------------------

    BridgeStarts = (
        bridge_starts
    )

    BridgeEnds = (
        bridge_ends
    )

    BridgeInfo = (
        bridge_info
    )

    BridgeCount = (
        len(
            bridge_starts
        )
    )


    # --------------------------------------------------------
    # STATUS
    # --------------------------------------------------------

    Status = (
        "SYSTEM GRAPH CONNECTED"
        + " | District pairs = "
        + str(
            len(
                adjacent_pairs
            )
        )
        + " | Connector levels = "
        + str(
            len(
                connector_levels
            )
        )
        + " | Inter-district edges = "
        + str(
            BridgeCount
        )
        + node_warning
    )
# ---------- end inter_district_connectors ----------
line_3 = Line(StartPoint=inter_district_connectors.BridgeStarts, EndPoint=inter_district_connectors.BridgeEnds)
district_pairs = Panel(inter_district_connectors.DistrictPairs)
bridge_information = Panel(inter_district_connectors.BridgeInfo)
bridge_count = Panel(inter_district_connectors.BridgeCount)
status = Panel(inter_district_connectors.Status)
custom_preview = CustomPreview(Geometry=line_3, Material=ColourSwatch(SwatchColor=RGB(0, 242, 255)))

# ---- group: RANDOMIZER POD ASSIGN
pod_random_seed = Slider(60, range=0..100)
construct_domain_4 = ConstructDomain(DomainStart="0", DomainEnd="5")
list_length_8 = ListLength(List=regular_planes_flat)
random = Random(Range=construct_domain_4, Number=list_length_8, Seed=pod_random_seed)
round = Round(Number=random)  # -> Nearest, Floor, Ceiling
pod_type_indices = Integer(round.Floor)
list_item_4 = ListItem(List=merge_2, Index=pod_type_indices, Wrap=True)
division_2 = Division(A=list_item_4, B="2")
division_3 = Division(A=pod_width, B="2")
rng_location = Panel(list_item_4)
negative_3 = Negative(Value=division_2)
negative_4 = Negative(Value=division_3)
construct_domain_5 = ConstructDomain(DomainStart=negative_3, DomainEnd=division_2)
construct_domain_6 = ConstructDomain(DomainStart=division_3, DomainEnd=negative_4)
construct_domain_7 = ConstructDomain(DomainStart="0", DomainEnd=pod_height)
center_box_2 = CenterBox(
    Base=regular_planes_flat,
    X=expr("x/2", construct_domain_6),
    Y=expr("x/2", construct_domain_5),
    Z=expr("x/2", construct_domain_7))

# ---- group: 03_CITY DISTRICT GRID (continued)
inter_district_edges = Line(line_3)

# ---- group: A* Search Algorythm
start_index = Slider(2413, range=0..5400)
goal_index = Slider(402, range=0..5400)
up_factor = Slider(1.3, range=0..5400)
turn_penalty = Slider(25, range=0..5400)
horizontal_after_vertical_penalty = Slider(1854, range=0..5400)
search_nodes = Point(flatten(city_nodes))
start_point = ListItem(List=search_nodes, Index=start_index, Wrap=True)
goal_point = ListItem(List=search_nodes, Index=goal_index, Wrap=True)
point_2 = Point(start_point)
point_3 = Point(goal_point)
sphere_2 = Sphere(Base=point_2, Radius="1")  # disabled
sphere_3 = Sphere(Base=point_3, Radius="1")  # disabled
colour_swatch = ColourSwatch(SwatchColor=RGB(0, 255, 17))

# ---- group: BYPASS HIGHWAY
district_lm_count = Slider(6, range=0..1000)
district_capacity = Slider(150, range=0..1000)
cluster_capacity = Slider(40, range=0..1000)
city_capacity = Slider(500, range=0..1000)
city_count = Slider(3, range=0..1000)
cluster_count = Slider(8, range=0..1000)
landmark_placement = Script(
    Nodes=search_nodes,
    DistrictCount=district_count,
    LevelCount=levels_z,
    PositionsPerLevel=base_horizontal_edges,
    CityCount=city_count,
    CityCapacity=city_capacity,
    DistrictLMCount=district_lm_count,
    DistrictCapacity=district_capacity,
    ClusterCount=cluster_count,
    ClusterCapacity=cluster_capacity)  # -> NodeIDs, NodePrograms, NodeCategories, NodeScales, NodeLabels, LandmarkIDs, LandmarkPts, LandmarkPrograms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; inputs Nodes: list of Point3d, DistrictCount: Int32, LevelCount: Int32, PositionsPerLevel: Int32, CityCount: Int32, CityCapacity: Int32, DistrictLMCount: Int32, DistrictCapacity: Int32, ClusterCount: Int32, ClusterCapacity: Int32
# ---------- landmark_placement: Python ----------
# ------------------------------------------------------------
# LANDMARK PLACEMENT
# ------------------------------------------------------------
#
# THREE SCALES:
#
# CITY
#   Medical Centre
#
# DISTRICT
#   District Food Production Unit
#
# CLUSTER
#   Civic / Social Hub
#
# Each landmark type has:
#
#   COUNT
#   CAPACITY
#
# COUNT determines how many units are created.
#
# CAPACITY = how many habitation nodes one unit is intended
# to support.
#
# Placement is deterministic and spatially distributed.
# ------------------------------------------------------------


# ------------------------------------------------------------
# DEFAULT OUTPUTS
# ------------------------------------------------------------

NodeIDs = []
NodePrograms = []
NodeCategories = []
NodeScales = []
NodeLabels = []

LandmarkIDs = []
LandmarkPts = []
LandmarkPrograms = []
LandmarkScales = []
LandmarkCapacities = []
LandmarkLoads = []
LandmarkInfo = []

Status = ""


# ------------------------------------------------------------
# BASIC CHECK
# ------------------------------------------------------------

if not Nodes:

    Status = "ERROR: No nodes received."

else:

    nodes = list(Nodes)

    node_count = len(nodes)

    district_count = int(DistrictCount)
    level_count = int(LevelCount)
    positions_per_level = int(PositionsPerLevel)

    city_count = max(
        0,
        int(CityCount)
    )

    city_capacity = max(
        1,
        int(CityCapacity)
    )

    district_lm_count = max(
        0,
        int(DistrictLMCount)
    )

    district_capacity = max(
        1,
        int(DistrictCapacity)
    )

    cluster_count = max(
        0,
        int(ClusterCount)
    )

    cluster_capacity = max(
        1,
        int(ClusterCapacity)
    )


    # --------------------------------------------------------
    # NODE NUMBERING
    # --------------------------------------------------------

    nodes_per_position = (
        level_count
        * district_count
    )


    def decode_node(node_id):

        position = (
            node_id
            // nodes_per_position
        )

        remainder = (
            node_id
            % nodes_per_position
        )

        level = (
            remainder
            // district_count
        )

        district = (
            remainder
            % district_count
        )

        return (
            district,
            level,
            position
        )


    # --------------------------------------------------------
    # DISTANCE
    # --------------------------------------------------------

    def distance(a_id, b_id):

        return (
            nodes[a_id]
            .DistanceTo(
                nodes[b_id]
            )
        )


    # --------------------------------------------------------
    # CITY CENTRE
    # --------------------------------------------------------

    centre_x = sum(
        p.X
        for p in nodes
    ) / float(node_count)

    centre_y = sum(
        p.Y
        for p in nodes
    ) / float(node_count)

    centre_z = sum(
        p.Z
        for p in nodes
    ) / float(node_count)


    def distance_to_city_centre(node_id):

        p = nodes[node_id]

        dx = p.X - centre_x
        dy = p.Y - centre_y
        dz = p.Z - centre_z

        return (
            dx * dx
            + dy * dy
            + dz * dz
        ) ** 0.5


    # --------------------------------------------------------
    # DEFAULT DATABASE
    # --------------------------------------------------------

    NodeIDs = list(
        range(node_count)
    )

    NodePrograms = [
        "Housing"
        for _ in range(node_count)
    ]

    NodeCategories = [
        "Habitation"
        for _ in range(node_count)
    ]

    NodeScales = [
        "Habitation"
        for _ in range(node_count)
    ]


    # --------------------------------------------------------
    # USED NODE STORAGE
    # --------------------------------------------------------

    occupied = set()

    landmark_ids = []
    landmark_programs = []
    landmark_scales = []
    landmark_capacities = []


    # --------------------------------------------------------
    # REGISTER LANDMARK
    # --------------------------------------------------------

    def register_landmark(
        node_id,
        programme,
        category,
        scale,
        capacity
    ):

        occupied.add(
            node_id
        )

        NodePrograms[node_id] = (
            programme
        )

        NodeCategories[node_id] = (
            category
        )

        NodeScales[node_id] = (
            scale
        )

        landmark_ids.append(
            node_id
        )

        landmark_programs.append(
            programme
        )

        landmark_scales.append(
            scale
        )

        landmark_capacities.append(
            capacity
        )


    # --------------------------------------------------------
    # FARTHEST AVAILABLE NODE
    # --------------------------------------------------------
    #
    # Used to spread repeated landmarks through the city.
    #
    # It finds the node whose distance to its nearest existing
    # landmark of the relevant group is largest.
    #
    # --------------------------------------------------------

    def farthest_available(
        reference_ids,
        allowed_ids=None
    ):

        if allowed_ids is None:

            candidates = [
                i
                for i in range(node_count)
                if i not in occupied
            ]

        else:

            candidates = [
                i
                for i in allowed_ids
                if i not in occupied
            ]


        if not candidates:

            return None


        if not reference_ids:

            return min(
                candidates,
                key=distance_to_city_centre
            )


        best_id = None
        best_score = -1.0


        for candidate in candidates:

            nearest = min(
                distance(
                    candidate,
                    reference
                )
                for reference
                in reference_ids
            )


            if nearest > best_score:

                best_score = nearest
                best_id = candidate


        return best_id


    # ========================================================
    # 1. CITY SCALE
    # ========================================================
    #
    # MEDICAL CENTRE
    #
    # First one is as close to the geometric city centre
    # as the graph allows.
    #
    # Additional ones spread apart.
    #
    # ========================================================

    city_ids = []


    for i in range(
        city_count
    ):

        if i == 0:

            available = [
                n
                for n in range(node_count)
                if n not in occupied
            ]

            if not available:
                break

            chosen = min(
                available,
                key=distance_to_city_centre
            )

        else:

            chosen = farthest_available(
                city_ids
            )


        if chosen is None:
            break


        register_landmark(

            chosen,

            "Medical Centre",

            "Medical / Health",

            "City",

            city_capacity
        )


        city_ids.append(
            chosen
        )


    # ========================================================
    # 2. DISTRICT SCALE
    # ========================================================
    #
    # DISTRICT FOOD PRODUCTION UNIT
    #
    # We want these spread throughout the city.
    #
    # We therefore use farthest-point placement.
    #
    # ========================================================

    district_landmark_ids = []


    for i in range(
        district_lm_count
    ):

        chosen = farthest_available(
            district_landmark_ids
        )


        if chosen is None:
            break


        register_landmark(

            chosen,

            "District Food Production Unit",

            "Food",

            "District",

            district_capacity
        )


        district_landmark_ids.append(
            chosen
        )


    # ========================================================
    # 3. CLUSTER SCALE
    # ========================================================
    #
    # CIVIC / SOCIAL HUB
    #
    # These are the smallest and most distributed landmarks.
    #
    # ========================================================

    cluster_ids = []


    for i in range(
        cluster_count
    ):

        chosen = farthest_available(
            cluster_ids
        )


        if chosen is None:
            break


        register_landmark(

            chosen,

            "Civic / Social Hub",

            "Civic / Social",

            "Cluster",

            cluster_capacity
        )


        cluster_ids.append(
            chosen
        )


    # --------------------------------------------------------
    # CALCULATE LANDMARK LOAD
    # --------------------------------------------------------
    #
    # Every remaining habitation node is assigned to the
    # nearest landmark OF EACH TYPE.
    #
    # This lets us evaluate whether capacity is sufficient.
    #
    # --------------------------------------------------------

    landmark_load_map = {}

    for landmark_id in landmark_ids:

        landmark_load_map[
            landmark_id
        ] = 0


    # --------------------------------------------------------
    # SEPARATE LANDMARK GROUPS
    # --------------------------------------------------------

    scale_groups = {

        "City": city_ids,

        "District":
            district_landmark_ids,

        "Cluster":
            cluster_ids
    }


    # --------------------------------------------------------
    # COUNT HOUSING COVERAGE
    # --------------------------------------------------------

    housing_ids = [

        i
        for i in range(node_count)

        if NodePrograms[i]
        == "Housing"
    ]


    for scale, ids in scale_groups.items():

        if not ids:
            continue


        for housing_id in housing_ids:

            closest = min(

                ids,

                key=lambda landmark_id:
                distance(
                    housing_id,
                    landmark_id
                )
            )


            landmark_load_map[
                closest
            ] += 1


    # --------------------------------------------------------
    # LANDMARK OUTPUTS
    # --------------------------------------------------------

    LandmarkIDs = (
        landmark_ids
    )

    LandmarkPts = [

        nodes[i]

        for i in landmark_ids
    ]

    LandmarkPrograms = (
        landmark_programs
    )

    LandmarkScales = (
        landmark_scales
    )

    LandmarkCapacities = (
        landmark_capacities
    )

    LandmarkLoads = [

        landmark_load_map[i]

        for i in landmark_ids
    ]


    # --------------------------------------------------------
    # LANDMARK INFORMATION
    # --------------------------------------------------------

    for index in range(
        len(landmark_ids)
    ):

        node_id = (
            landmark_ids[index]
        )

        programme = (
            landmark_programs[index]
        )

        scale = (
            landmark_scales[index]
        )

        capacity = (
            landmark_capacities[index]
        )

        load = (
            landmark_load_map[
                node_id
            ]
        )


        if load <= capacity:

            capacity_status = (
                "OK"
            )

        else:

            capacity_status = (
                "OVER CAPACITY"
            )


        district, level, position = (
            decode_node(
                node_id
            )
        )


        info = (

            "{}"
            " | {}"
            " | Node {}"
            " | D{} L{} P{}"
            " | Load {}"
            " / Capacity {}"
            " | {}"

        ).format(

            scale,

            programme,

            node_id,

            district + 1,
            level + 1,
            position + 1,

            load,
            capacity,

            capacity_status
        )


        LandmarkInfo.append(
            info
        )


    # --------------------------------------------------------
    # NODE LABELS
    # --------------------------------------------------------

    for node_id in NodeIDs:

        district, level, position = (
            decode_node(
                node_id
            )
        )


        label = (

            "ID {}"
            " | D{:02d}"
            " | L{:02d}"
            " | P{:02d}"
            " | {}"
            " | {}"
            " | {}"

        ).format(

            node_id,

            district + 1,
            level + 1,
            position + 1,

            NodePrograms[node_id],

            NodeCategories[node_id],

            NodeScales[node_id]
        )


        NodeLabels.append(
            label
        )


    # --------------------------------------------------------
    # STATUS
    # --------------------------------------------------------

    total_landmarks = len(
        landmark_ids
    )


    Status = (

        "LANDMARK DATABASE CREATED"
        + " | Housing nodes = "
        + str(
            len(housing_ids)
        )
        + " | City = "
        + str(
            len(city_ids)
        )
        + " | District = "
        + str(
            len(
                district_landmark_ids
            )
        )
        + " | Cluster = "
        + str(
            len(cluster_ids)
        )
        + " | Total landmarks = "
        + str(
            total_landmarks
        )
    )
# ---------- end landmark_placement ----------
custom_preview_2 = CustomPreview(Geometry=landmark_placement.LandmarkPts, Material=ColourSwatch(SwatchColor=RGB(255, 196, 0)))
district_extra_connections = Slider(2, range=0..10)
city_extra_connections = Slider(1, range=0..10)
city_count_2 = Slider(0, range=0..10)
hierarchical_bypass_network = Script(
    LandmarkPts=landmark_placement.LandmarkPts,
    LandmarkIDs=landmark_placement.LandmarkIDs,
    LandmarkPrograms=landmark_placement.LandmarkPrograms,
    LandmarkScales=landmark_placement.LandmarkScales,
    CityExtraConnections=city_extra_connections,
    DistrictExtraConnections=district_extra_connections,
    ClusterExtraConnections=city_count_2)  # -> CityStartIDs, CityEndIDs, DistrictStartIDs, DistrictEndIDs, ClusterStartIDs, ClusterEndIDs, AllStartIDs, AllEndIDs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; inputs LandmarkPts: list of Point3d, LandmarkIDs: list of Int32, LandmarkPrograms: list, LandmarkScales: list, CityExtraConnections: Int32
# ---------- hierarchical_bypass_network: Python ----------
# ------------------------------------------------------------
# HIERARCHICAL BYPASS NETWORK
# ------------------------------------------------------------
#
# LANDMARK HIERARCHY:
#
# CITY
#   Major backbone
#
# DISTRICT
#   Secondary distribution backbone
#
# CLUSTER
#   Local branches
#
#
# NETWORK LOGIC:
#
# 1. CITY landmarks:
#       Minimum Spanning Tree between City landmarks.
#
# 2. DISTRICT landmarks:
#       Minimum Spanning Tree between District landmarks.
#
# 3. CITY -> DISTRICT:
#       One shortest gateway connection links the
#       District network to the City backbone.
#
# 4. CLUSTER landmarks:
#       Every Cluster landmark connects to its nearest
#       District landmark.
#
#       If no District landmarks exist, it falls back
#       to the nearest City landmark.
#
# 5. Optional extra connections:
#
#       CityExtraConnections
#       DistrictExtraConnections
#       ClusterExtraConnections
#
# OUTPUTS ARE GLOBAL CITY NODE IDs.
#
# Reconstruct geometry OUTSIDE Python using:
#
# FLATTEN SEARCH NODES -> List Item L
# Start IDs            -> List Item i
#
# FLATTEN SEARCH NODES -> List Item L
# End IDs              -> List Item i
#
# ------------------------------------------------------------


# ------------------------------------------------------------
# DEFAULT OUTPUTS
# ------------------------------------------------------------

CityStartIDs = []
CityEndIDs = []

DistrictStartIDs = []
DistrictEndIDs = []

ClusterStartIDs = []
ClusterEndIDs = []

AllStartIDs = []
AllEndIDs = []

ConnectionTypes = []
BypassInfo = []

BypassCount = 0
TotalLength = 0.0

Status = ""


# ------------------------------------------------------------
# BASIC CHECK
# ------------------------------------------------------------

if not LandmarkPts:

    Status = "ERROR: No landmark points received."

else:

    points = list(LandmarkPts)

    point_count = len(points)


    # --------------------------------------------------------
    # EXTRA CONNECTION SETTINGS
    # --------------------------------------------------------

    if CityExtraConnections is None:

        city_extra = 0

    else:

        city_extra = max(
            0,
            int(CityExtraConnections)
        )


    if DistrictExtraConnections is None:

        district_extra = 0

    else:

        district_extra = max(
            0,
            int(DistrictExtraConnections)
        )


    if ClusterExtraConnections is None:

        cluster_extra = 0

    else:

        cluster_extra = max(
            0,
            int(ClusterExtraConnections)
        )


    # --------------------------------------------------------
    # LANDMARK METADATA
    # --------------------------------------------------------

    if LandmarkIDs:

        ids = list(LandmarkIDs)

    else:

        ids = list(
            range(point_count)
        )


    if LandmarkPrograms:

        programs = list(
            LandmarkPrograms
        )

    else:

        programs = [
            "Landmark"
            for _ in range(point_count)
        ]


    if LandmarkScales:

        scales = list(
            LandmarkScales
        )

    else:

        scales = [
            "Unknown"
            for _ in range(point_count)
        ]


    # --------------------------------------------------------
    # SAFETY: MAKE METADATA LISTS LONG ENOUGH
    # --------------------------------------------------------

    while len(ids) < point_count:

        ids.append(
            len(ids)
        )


    while len(programs) < point_count:

        programs.append(
            "Landmark"
        )


    while len(scales) < point_count:

        scales.append(
            "Unknown"
        )


    # --------------------------------------------------------
    # NORMALIZE SCALE NAMES
    # --------------------------------------------------------
    #
    # This means:
    #
    # "City"
    # "CITY"
    # "city"
    #
    # all work.
    #
    # --------------------------------------------------------

    normalized_scales = []

    for scale in scales:

        normalized_scales.append(
            str(scale)
            .strip()
            .lower()
        )


    # --------------------------------------------------------
    # SEPARATE LANDMARKS BY SCALE
    # --------------------------------------------------------

    city_indices = []

    district_indices = []

    cluster_indices = []


    for i in range(point_count):

        scale = normalized_scales[i]


        if scale == "city":

            city_indices.append(i)


        elif scale == "district":

            district_indices.append(i)


        elif scale == "cluster":

            cluster_indices.append(i)


    # --------------------------------------------------------
    # DISTANCE FUNCTION
    # --------------------------------------------------------

    def distance(a, b):

        return (
            points[a]
            .DistanceTo(
                points[b]
            )
        )


    # --------------------------------------------------------
    # BUILD ALL POSSIBLE EDGES INSIDE ONE GROUP
    # --------------------------------------------------------

    def all_group_edges(group):

        result = []


        for i in range(
            len(group)
        ):

            for j in range(
                i + 1,
                len(group)
            ):

                a = group[i]
                b = group[j]

                d = distance(
                    a,
                    b
                )

                result.append(
                    (
                        d,
                        a,
                        b
                    )
                )


        result.sort(
            key=lambda edge:
            edge[0]
        )


        return result


    # --------------------------------------------------------
    # BUILD MST FOR ONE GROUP
    # --------------------------------------------------------
    #
    # Returns:
    #
    # [
    #   (distance, a, b, "MST"),
    #   ...
    # ]
    #
    # --------------------------------------------------------

    def build_mst(group):

        if len(group) <= 1:

            return []


        possible_edges = (
            all_group_edges(
                group
            )
        )


        parent = {}

        rank = {}


        for landmark_index in group:

            parent[
                landmark_index
            ] = landmark_index

            rank[
                landmark_index
            ] = 0


        def find(x):

            while parent[x] != x:

                parent[x] = (
                    parent[
                        parent[x]
                    ]
                )

                x = parent[x]

            return x


        def union(a, b):

            root_a = find(a)

            root_b = find(b)


            if root_a == root_b:

                return False


            if (
                rank[root_a]
                < rank[root_b]
            ):

                parent[root_a] = (
                    root_b
                )


            elif (
                rank[root_a]
                > rank[root_b]
            ):

                parent[root_b] = (
                    root_a
                )


            else:

                parent[root_b] = (
                    root_a
                )

                rank[root_a] += 1


            return True


        selected = []


        for (
            d,
            a,
            b
        ) in possible_edges:


            if union(
                a,
                b
            ):

                selected.append(
                    (
                        d,
                        a,
                        b,
                        "MST"
                    )
                )


            if (
                len(selected)
                == len(group) - 1
            ):

                break


        return selected


    # --------------------------------------------------------
    # ADD EXTRA EDGES TO A GROUP
    # --------------------------------------------------------

    def add_group_extras(
        group,
        existing_edges,
        extra_count
    ):

        if (
            len(group) <= 1
            or extra_count <= 0
        ):

            return []


        possible_edges = (
            all_group_edges(
                group
            )
        )


        used_pairs = set()


        for edge in existing_edges:

            d, a, b, edge_type = edge

            pair = (
                min(a, b),
                max(a, b)
            )

            used_pairs.add(
                pair
            )


        extras = []


        for (
            d,
            a,
            b
        ) in possible_edges:


            if (
                len(extras)
                >= extra_count
            ):

                break


            pair = (
                min(a, b),
                max(a, b)
            )


            if pair in used_pairs:

                continue


            extras.append(
                (
                    d,
                    a,
                    b,
                    "EXTRA"
                )
            )


            used_pairs.add(
                pair
            )


        return extras


    # ========================================================
    # CITY NETWORK
    # ========================================================

    city_edges = (
        build_mst(
            city_indices
        )
    )


    city_extras = (
        add_group_extras(
            city_indices,
            city_edges,
            city_extra
        )
    )


    city_edges.extend(
        city_extras
    )


    # ========================================================
    # DISTRICT NETWORK
    # ========================================================

    district_edges = (
        build_mst(
            district_indices
        )
    )


    district_extras = (
        add_group_extras(
            district_indices,
            district_edges,
            district_extra
        )
    )


    district_edges.extend(
        district_extras
    )


    # ========================================================
    # CITY -> DISTRICT GATEWAY
    # ========================================================
    #
    # The District backbone only needs ONE connection into
    # the City backbone for the whole hierarchy to become
    # connected.
    #
    # Find shortest possible City-District pair.
    #
    # ========================================================

    gateway_edge = None


    if (
        city_indices
        and district_indices
    ):

        best_distance = None

        best_city = None

        best_district = None


        for city_index in city_indices:

            for district_index in district_indices:

                d = distance(
                    city_index,
                    district_index
                )


                if (
                    best_distance is None
                    or d < best_distance
                ):

                    best_distance = d

                    best_city = (
                        city_index
                    )

                    best_district = (
                        district_index
                    )


        if (
            best_city is not None
            and best_district is not None
        ):

            gateway_edge = (
                best_distance,
                best_city,
                best_district,
                "CITY-DISTRICT GATEWAY"
            )


            # Treat gateway as part of
            # District network visualization.

            district_edges.append(
                gateway_edge
            )


    # ========================================================
    # CLUSTER NETWORK
    # ========================================================
    #
    # Each Cluster landmark connects to the nearest
    # District landmark.
    #
    # Fallback:
    # If there are no District landmarks, connect it
    # to nearest City landmark.
    #
    # ========================================================

    cluster_edges = []


    if district_indices:

        cluster_targets = (
            district_indices
        )

        target_label = (
            "DISTRICT"
        )


    elif city_indices:

        cluster_targets = (
            city_indices
        )

        target_label = (
            "CITY"
        )


    else:

        cluster_targets = []

        target_label = (
            "NONE"
        )


    for cluster_index in cluster_indices:


        if not cluster_targets:

            break


        nearest_target = min(

            cluster_targets,

            key=lambda target:
            distance(
                cluster_index,
                target
            )
        )


        d = distance(
            cluster_index,
            nearest_target
        )


        cluster_edges.append(
            (
                d,
                cluster_index,
                nearest_target,
                "CLUSTER-{}".format(
                    target_label
                )
            )
        )


    # ========================================================
    # EXTRA CLUSTER CONNECTIONS
    # ========================================================
    #
    # Additional Cluster connections are made toward
    # District landmarks.
    #
    # This can create redundancy:
    #
    # Cluster
    #   |\ 
    #   | \
    # District District
    #
    # ========================================================

    if (
        cluster_extra > 0
        and cluster_indices
        and cluster_targets
    ):


        used_pairs = set()


        for (
            d,
            a,
            b,
            edge_type
        ) in cluster_edges:

            used_pairs.add(
                (
                    min(a, b),
                    max(a, b)
                )
            )


        possible_cluster_edges = []


        for cluster_index in cluster_indices:

            for target_index in cluster_targets:

                pair = (
                    min(
                        cluster_index,
                        target_index
                    ),
                    max(
                        cluster_index,
                        target_index
                    )
                )


                if pair in used_pairs:

                    continue


                d = distance(
                    cluster_index,
                    target_index
                )


                possible_cluster_edges.append(
                    (
                        d,
                        cluster_index,
                        target_index
                    )
                )


        possible_cluster_edges.sort(
            key=lambda edge:
            edge[0]
        )


        cluster_extras_added = 0


        for (
            d,
            a,
            b
        ) in possible_cluster_edges:


            if (
                cluster_extras_added
                >= cluster_extra
            ):

                break


            pair = (
                min(a, b),
                max(a, b)
            )


            if pair in used_pairs:

                continue


            cluster_edges.append(
                (
                    d,
                    a,
                    b,
                    "CLUSTER EXTRA"
                )
            )


            used_pairs.add(
                pair
            )


            cluster_extras_added += 1


    # --------------------------------------------------------
    # OUTPUT STORAGE
    # --------------------------------------------------------

    city_start_ids = []
    city_end_ids = []

    district_start_ids = []
    district_end_ids = []

    cluster_start_ids = []
    cluster_end_ids = []

    all_start_ids = []
    all_end_ids = []

    connection_types = []
    bypass_info = []

    total_length = 0.0


    # --------------------------------------------------------
    # OUTPUT HELPER
    # --------------------------------------------------------

    def process_edge(
        edge,
        network_name,
        start_list,
        end_list
    ):

        global total_length


        (
            d,
            a,
            b,
            edge_type
        ) = edge


        start_id = int(
            ids[a]
        )

        end_id = int(
            ids[b]
        )


        # Scale-specific output

        start_list.append(
            start_id
        )

        end_list.append(
            end_id
        )


        # Combined output

        all_start_ids.append(
            start_id
        )

        all_end_ids.append(
            end_id
        )


        connection_types.append(
            network_name
            + " | "
            + edge_type
        )


        total_length += d


        info = (

            "{}"
            " | {}"
            " | {} / {}"
            " -> "
            "{} / {}"
            " | Node {} -> {}"
            " | Length = {} m"

        ).format(

            network_name,

            edge_type,

            scales[a],
            programs[a],

            scales[b],
            programs[b],

            start_id,
            end_id,

            round(
                d,
                2
            )
        )


        bypass_info.append(
            info
        )


    # --------------------------------------------------------
    # PROCESS CITY EDGES
    # --------------------------------------------------------

    for edge in city_edges:

        process_edge(

            edge,

            "CITY NETWORK",

            city_start_ids,
            city_end_ids
        )


    # --------------------------------------------------------
    # PROCESS DISTRICT EDGES
    # --------------------------------------------------------

    for edge in district_edges:

        process_edge(

            edge,

            "DISTRICT NETWORK",

            district_start_ids,
            district_end_ids
        )


    # --------------------------------------------------------
    # PROCESS CLUSTER EDGES
    # --------------------------------------------------------

    for edge in cluster_edges:

        process_edge(

            edge,

            "CLUSTER NETWORK",

            cluster_start_ids,
            cluster_end_ids
        )


    # --------------------------------------------------------
    # FINAL OUTPUTS
    # --------------------------------------------------------

    CityStartIDs = (
        city_start_ids
    )

    CityEndIDs = (
        city_end_ids
    )


    DistrictStartIDs = (
        district_start_ids
    )

    DistrictEndIDs = (
        district_end_ids
    )


    ClusterStartIDs = (
        cluster_start_ids
    )

    ClusterEndIDs = (
        cluster_end_ids
    )


    AllStartIDs = (
        all_start_ids
    )

    AllEndIDs = (
        all_end_ids
    )


    ConnectionTypes = (
        connection_types
    )

    BypassInfo = (
        bypass_info
    )


    BypassCount = len(
        all_start_ids
    )

    TotalLength = (
        total_length
    )


    # --------------------------------------------------------
    # STATUS
    # --------------------------------------------------------

    Status = (

        "HIERARCHICAL BYPASS CREATED"

        + " | City landmarks = "
        + str(
            len(city_indices)
        )

        + " | District landmarks = "
        + str(
            len(district_indices)
        )

        + " | Cluster landmarks = "
        + str(
            len(cluster_indices)
        )

        + " | City connections = "
        + str(
            len(city_start_ids)
        )

        + " | District connections = "
        + str(
            len(district_start_ids)
        )

        + " | Cluster connections = "
        + str(
            len(cluster_start_ids)
        )

        + " | Total connections = "
        + str(
            BypassCount
        )

        + " | Total length = "
        + str(
            round(
                TotalLength,
                2
            )
        )

        + " m"
    )
# ---------- end hierarchical_bypass_network ----------
panel_7 = Panel(landmark_placement.Status)
status_2 = Panel(hierarchical_bypass_network.Status)
end_id = Panel(hierarchical_bypass_network.BypassInfo)
count = Panel(hierarchical_bypass_network.BypassCount)

# ---- group: CITY DATABASE
query_node = Slider(126, range=0..5400)
city_database_script = Script(
    Nodes=search_nodes,
    DistrictCount=district_count,
    LevelCount=levels_z,
    PositionsPerLevel=base_horizontal_edges,
    LandmarkIDs=landmark_placement.LandmarkIDs,
    LandmarkPrograms=landmark_placement.LandmarkPrograms,
    LandmarkScales=landmark_placement.LandmarkScales,
    QueryID=query_node)  # -> NodeIDs, NodePrograms, NodeCategories, NodeScales, NodePodTypes, NodeLabels, QueryInfo, Status; inputs Nodes: list of Point3d, DistrictCount: Int32, LevelCount: Int32, PositionsPerLevel: Int32, LandmarkIDs: list of Int32, LandmarkPrograms: list of String, LandmarkScales: list, QueryID: Int32
# ---------- city_database_script: Python ----------
# ------------------------------------------------------------
# CITY DATABASE
# ------------------------------------------------------------
#
# Reads landmark information DIRECTLY from the
# LANDMARK PLACEMENT component.
#
# Every graph node defaults to:
#
#   Housing
#   Habitation
#   Housing Pod
#
# Landmark nodes automatically override those values.
#
# This means that when LANDMARK PLACEMENT changes,
# the entire city database updates automatically.
#
# ------------------------------------------------------------


# ------------------------------------------------------------
# DEFAULT OUTPUTS
# ------------------------------------------------------------

NodeIDs = []

NodePrograms = []
NodeCategories = []
NodeScales = []
NodePodTypes = []

NodeLabels = []

QueryInfo = ""
Status = ""


# ------------------------------------------------------------
# BASIC CHECK
# ------------------------------------------------------------

if not Nodes:

    Status = "ERROR: No nodes received."

else:

    nodes = list(Nodes)

    node_count = len(nodes)

    district_count = int(DistrictCount)
    level_count = int(LevelCount)
    positions_per_level = int(
        PositionsPerLevel
    )


    # --------------------------------------------------------
    # NODE NUMBERING STRUCTURE
    # --------------------------------------------------------
    #
    # Flattened order:
    #
    # Position
    #   -> Level
    #       -> District
    #
    # --------------------------------------------------------

    nodes_per_position = (
        level_count
        * district_count
    )


    # --------------------------------------------------------
    # DECODE NODE ID
    # --------------------------------------------------------

    def decode_node(node_id):

        position = (
            node_id
            // nodes_per_position
        )

        remainder = (
            node_id
            % nodes_per_position
        )

        level = (
            remainder
            // district_count
        )

        district = (
            remainder
            % district_count
        )

        return (
            district,
            level,
            position
        )


    # --------------------------------------------------------
    # PROGRAMME -> FUNCTIONAL CATEGORY
    # --------------------------------------------------------

    category_map = {

        # HABITATION

        "Housing":
            "Habitation",


        # FOOD

        "Major Food Production Complex":
            "Food",

        "District Food Production Unit":
            "Food",

        "Local Food / Emergency Storage":
            "Food",


        # MEDICAL

        "Central Hospital":
            "Medical / Health",

        "Medical Centre":
            "Medical / Health",

        "First Aid / Medical Station":
            "Medical / Health",


        # LIFE SUPPORT

        "Oxygen Production Unit":
            "Life Support / Atmosphere",

        "Atmosphere Processing Unit":
            "Life Support / Atmosphere",

        "Emergency Oxygen Storage":
            "Life Support / Atmosphere",

        "CO2 Scrubber / Air Treatment":
            "Life Support / Atmosphere",

        "Pressure Control System":
            "Life Support / Atmosphere",


        # WATER

        "Main Water Extraction + Storage":
            "Water",

        "Water Recycling Unit":
            "Water",

        "Water Buffer Tank":
            "Water",


        # WASTE

        "Waste / Sewage Processing Unit":
            "Waste",

        "Local Sewage Collection":
            "Waste",


        # ELECTRICAL

        "Main Power Generation Unit":
            "Electrical",

        "Electrical Substation + Battery Unit":
            "Electrical",

        "Local Battery Storage":
            "Electrical",


        # THERMAL

        "Thermal / Heat Distribution Hub":
            "Heat / Thermal",

        "Heat Exchanger":
            "Heat / Thermal",


        # INDUSTRY

        "Hydrocarbon / Refinery Complex":
            "Industry / Manufacturing",

        "Main Manufacturing / Material Processing Unit":
            "Industry / Manufacturing",

        "Manufacturing / Repair Workshop":
            "Industry / Manufacturing",

        "Local Maintenance Room":
            "Industry / Manufacturing",


        # TRANSPORT

        "Central Transport Hub":
            "Transport / Mobility",

        "Transport Interchange":
            "Transport / Mobility",

        "Vehicle / Drone Depot":
            "Transport / Mobility",


        # RESEARCH

        "Research + External Operations Centre":
            "Research / Science",


        # CIVIC

        "Civic / Social Hub":
            "Civic / Social",


        # EMERGENCY

        "Emergency / Refuge Unit":
            "Emergency / Safety",

        "Fire Suppression System":
            "Emergency / Safety",


        # LOGISTICS

        "Central Storage / Logistics Unit":
            "Logistics / Storage",


        # CONTROL

        "Central Control + Communication Unit":
            "Control / Communication",

        "Local Communication Node":
            "Control / Communication",


        # EXTERNAL

        "External Airlock Hub":
            "External Operations"
    }


    # --------------------------------------------------------
    # SCALE -> POD TYPE
    # --------------------------------------------------------
    #
    # This is the architectural type that actually occupies
    # the graph location.
    #
    # --------------------------------------------------------

    def scale_to_pod_type(scale):

        scale_text = (
            str(scale)
            .strip()
            .lower()
        )


        if scale_text == "city":

            return (
                "City Landmark Pod"
            )


        elif scale_text == "district":

            return (
                "District Landmark Pod"
            )


        elif scale_text == "cluster":

            return (
                "Cluster Landmark Pod"
            )


        else:

            return (
                "Housing Pod"
            )


    # --------------------------------------------------------
    # CREATE DEFAULT DATABASE
    # --------------------------------------------------------

    NodeIDs = list(
        range(node_count)
    )


    # Every node begins as habitation.

    NodePrograms = [
        "Housing"
        for _ in range(node_count)
    ]


    NodeCategories = [
        "Habitation"
        for _ in range(node_count)
    ]


    NodeScales = [
        "Habitation"
        for _ in range(node_count)
    ]


    NodePodTypes = [
        "Housing Pod"
        for _ in range(node_count)
    ]


    # --------------------------------------------------------
    # READ LANDMARK PLACEMENT DATA
    # --------------------------------------------------------

    landmark_ids = []

    if LandmarkIDs:

        landmark_ids = list(
            LandmarkIDs
        )


    landmark_programs = []

    if LandmarkPrograms:

        landmark_programs = list(
            LandmarkPrograms
        )


    landmark_scales = []

    if LandmarkScales:

        landmark_scales = list(
            LandmarkScales
        )


    # --------------------------------------------------------
    # DETERMINE VALID ASSIGNMENT COUNT
    # --------------------------------------------------------

    assignment_count = min(
        len(landmark_ids),
        len(landmark_programs),
        len(landmark_scales)
    )


    invalid_ids = []


    # --------------------------------------------------------
    # APPLY LANDMARKS TO CITY DATABASE
    # --------------------------------------------------------

    for i in range(
        assignment_count
    ):

        node_id = int(
            landmark_ids[i]
        )

        programme = str(
            landmark_programs[i]
        )

        scale = str(
            landmark_scales[i]
        )


        if (
            0
            <= node_id
            < node_count
        ):

            # --------------------------------------------
            # PROGRAMME
            # --------------------------------------------

            NodePrograms[
                node_id
            ] = programme


            # --------------------------------------------
            # FUNCTIONAL CATEGORY
            # --------------------------------------------

            NodeCategories[
                node_id
            ] = category_map.get(
                programme,
                "Other"
            )


            # --------------------------------------------
            # LANDMARK SCALE
            # --------------------------------------------

            NodeScales[
                node_id
            ] = scale


            # --------------------------------------------
            # POD TYPE
            # --------------------------------------------

            NodePodTypes[
                node_id
            ] = scale_to_pod_type(
                scale
            )


        else:

            invalid_ids.append(
                node_id
            )


    # --------------------------------------------------------
    # CREATE HUMAN-READABLE NODE LABELS
    # --------------------------------------------------------

    for node_id in NodeIDs:

        (
            district,
            level,
            position
        ) = decode_node(
            node_id
        )


        label = (

            "ID {}"
            " | D{:02d}"
            " | L{:02d}"
            " | P{:02d}"
            " | {}"
            " | {}"
            " | {}"
            " | {}"

        ).format(

            node_id,

            district + 1,

            level + 1,

            position + 1,

            NodePodTypes[
                node_id
            ],

            NodePrograms[
                node_id
            ],

            NodeCategories[
                node_id
            ],

            NodeScales[
                node_id
            ]
        )


        NodeLabels.append(
            label
        )


    # --------------------------------------------------------
    # QUERY ONE NODE
    # --------------------------------------------------------

    if QueryID is None:

        query_id = 0

    else:

        query_id = int(
            QueryID
        )


    if (
        0
        <= query_id
        < node_count
    ):

        (
            district,
            level,
            position
        ) = decode_node(
            query_id
        )


        QueryInfo = (

            "NODE {}\n"
            "\n"
            "LOCATION\n"
            "District: {}\n"
            "Level: {}\n"
            "Perimeter Position: {}\n"
            "\n"
            "POD INFORMATION\n"
            "Pod Type: {}\n"
            "Programme: {}\n"
            "Category: {}\n"
            "Scale: {}"

        ).format(

            query_id,

            district + 1,

            level + 1,

            position + 1,

            NodePodTypes[
                query_id
            ],

            NodePrograms[
                query_id
            ],

            NodeCategories[
                query_id
            ],

            NodeScales[
                query_id
            ]
        )


    else:

        QueryInfo = (
            "ERROR: Query ID outside "
            "valid node range."
        )


    # --------------------------------------------------------
    # COUNT POD TYPES
    # --------------------------------------------------------

    housing_count = 0
    city_count = 0
    district_landmark_count = 0
    cluster_count = 0


    for pod_type in NodePodTypes:

        if (
            pod_type
            == "Housing Pod"
        ):

            housing_count += 1


        elif (
            pod_type
            == "City Landmark Pod"
        ):

            city_count += 1


        elif (
            pod_type
            == "District Landmark Pod"
        ):

            district_landmark_count += 1


        elif (
            pod_type
            == "Cluster Landmark Pod"
        ):

            cluster_count += 1


    # --------------------------------------------------------
    # STATUS
    # --------------------------------------------------------

    Status = (

        "CITY DATABASE CREATED"

        + " | Nodes = "
        + str(
            node_count
        )

        + " | Housing = "
        + str(
            housing_count
        )

        + " | City landmarks = "
        + str(
            city_count
        )

        + " | District landmarks = "
        + str(
            district_landmark_count
        )

        + " | Cluster landmarks = "
        + str(
            cluster_count
        )

        + " | Total landmarks = "
        + str(
            assignment_count
        )
    )


    # --------------------------------------------------------
    # WARNINGS
    # --------------------------------------------------------

    if not (
        len(landmark_ids)
        == len(landmark_programs)
        == len(landmark_scales)
    ):

        Status += (
            " | WARNING: Landmark metadata "
            "lists have different lengths"
        )


    if invalid_ids:

        Status += (
            " | Invalid Landmark IDs: "
            + str(
                invalid_ids
            )
        )
# ---------- end city_database_script ----------
query_info = Panel(city_database_script.QueryInfo)
status_3 = Panel(city_database_script.Status)
query_info_2 = Panel(city_database_script.NodeLabels)

# ----
custom_preview_3 = CustomPreview(Geometry=sphere_2, Material=colour_swatch)
custom_preview_4 = CustomPreview(Geometry=sphere_3, Material=colour_swatch)

# ---- group: PODS REMOVED BY BYPASS
clearance = Slider(6, range=0..20)
bypass_pod_removal = Script(
    Nodes=search_nodes,
    BypassStartIDs=hierarchical_bypass_network.AllStartIDs,
    BypassEndIDs=hierarchical_bypass_network.AllEndIDs,
    ProtectedIDs=landmark_placement.LandmarkIDs,
    Clearance=clearance)  # -> RemoveIDs, KeepIDs, RemovedPts, KeptPts, NodeDistances, RemoveCount, KeepCount, Status; inputs Nodes: list of Point3d, BypassStartIDs: list of Int32, BypassEndIDs: list of Int32, ProtectedIDs: list of Int32, Clearance: Int32
# ---------- bypass_pod_removal: Python ----------
# ------------------------------------------------------------
# BYPASS POD REMOVAL
# ------------------------------------------------------------
#
# Determines which city nodes / habitation pods lie too close
# to the hierarchical bypass network.
#
# Those nodes can then be removed from the pod geometry,
# creating irregular blocks and 3D circulation corridors.
#
#
# INPUTS:
#
# Nodes
# BypassStartIDs
# BypassEndIDs
# ProtectedIDs
# Clearance
#
#
# OUTPUTS:
#
# RemoveIDs
# KeepIDs
#
# RemovedPts
# KeptPts
#
# NodeDistances
#
# RemoveCount
# KeepCount
#
# Status
#
# ------------------------------------------------------------


# ------------------------------------------------------------
# DEFAULT OUTPUTS
# ------------------------------------------------------------

RemoveIDs = []
KeepIDs = []

RemovedPts = []
KeptPts = []

NodeDistances = []

RemoveCount = 0
KeepCount = 0

Status = ""


# ------------------------------------------------------------
# BASIC CHECK
# ------------------------------------------------------------

if not Nodes:

    Status = "ERROR: No nodes received."

elif not BypassStartIDs or not BypassEndIDs:

    Status = "ERROR: No bypass connections received."

else:

    nodes = list(Nodes)

    node_count = len(nodes)


    # --------------------------------------------------------
    # CLEARANCE
    # --------------------------------------------------------

    if Clearance is None:

        clearance = 15.0

    else:

        clearance = max(
            0.0,
            float(Clearance)
        )


    # --------------------------------------------------------
    # BYPASS IDS
    # --------------------------------------------------------

    start_ids = list(
        BypassStartIDs
    )

    end_ids = list(
        BypassEndIDs
    )


    connection_count = min(
        len(start_ids),
        len(end_ids)
    )


    # --------------------------------------------------------
    # PROTECTED LANDMARK IDS
    # --------------------------------------------------------

    protected = set()


    if ProtectedIDs:

        for node_id in ProtectedIDs:

            try:

                node_id = int(
                    node_id
                )

                if (
                    0 <= node_id < node_count
                ):

                    protected.add(
                        node_id
                    )

            except:

                pass


    # --------------------------------------------------------
    # BUILD VALID BYPASS SEGMENTS
    # --------------------------------------------------------

    segments = []


    invalid_connections = 0


    for i in range(
        connection_count
    ):

        try:

            a_id = int(
                start_ids[i]
            )

            b_id = int(
                end_ids[i]
            )

        except:

            invalid_connections += 1
            continue


        if not (
            0 <= a_id < node_count
            and
            0 <= b_id < node_count
        ):

            invalid_connections += 1
            continue


        a = nodes[
            a_id
        ]

        b = nodes[
            b_id
        ]


        segments.append(
            (
                a_id,
                b_id,
                a,
                b
            )
        )


    # --------------------------------------------------------
    # POINT -> LINE SEGMENT DISTANCE
    # --------------------------------------------------------
    #
    # Finds shortest 3D distance between:
    #
    # city node P
    #
    # and bypass segment A ---- B
    #
    # This is true finite-segment distance,
    # not distance to an infinite line.
    #
    # --------------------------------------------------------

    def point_segment_distance(
        p,
        a,
        b
    ):

        ab_x = (
            b.X - a.X
        )

        ab_y = (
            b.Y - a.Y
        )

        ab_z = (
            b.Z - a.Z
        )


        ap_x = (
            p.X - a.X
        )

        ap_y = (
            p.Y - a.Y
        )

        ap_z = (
            p.Z - a.Z
        )


        ab_length_squared = (

            ab_x * ab_x
            +
            ab_y * ab_y
            +
            ab_z * ab_z
        )


        # --------------------------------------------
        # Zero-length segment protection
        # --------------------------------------------

        if (
            ab_length_squared
            <= 0.0000001
        ):

            dx = p.X - a.X
            dy = p.Y - a.Y
            dz = p.Z - a.Z


            return (

                dx * dx
                +
                dy * dy
                +
                dz * dz

            ) ** 0.5


        # --------------------------------------------
        # Projection parameter
        # --------------------------------------------

        t = (

            (
                ap_x * ab_x
                +
                ap_y * ab_y
                +
                ap_z * ab_z
            )

            / ab_length_squared
        )


        # --------------------------------------------
        # Clamp to finite segment
        # --------------------------------------------

        if t < 0.0:

            t = 0.0


        elif t > 1.0:

            t = 1.0


        # --------------------------------------------
        # Closest point on segment
        # --------------------------------------------

        closest_x = (
            a.X
            + t * ab_x
        )

        closest_y = (
            a.Y
            + t * ab_y
        )

        closest_z = (
            a.Z
            + t * ab_z
        )


        # --------------------------------------------
        # Distance
        # --------------------------------------------

        dx = (
            p.X
            - closest_x
        )

        dy = (
            p.Y
            - closest_y
        )

        dz = (
            p.Z
            - closest_z
        )


        return (

            dx * dx
            +
            dy * dy
            +
            dz * dz

        ) ** 0.5


    # --------------------------------------------------------
    # TEST EVERY CITY NODE
    # --------------------------------------------------------

    remove_ids = []

    keep_ids = []

    removed_pts = []

    kept_pts = []

    node_distances = []


    for node_id in range(
        node_count
    ):

        p = nodes[
            node_id
        ]


        # --------------------------------------------
        # FIND DISTANCE TO NEAREST BYPASS SEGMENT
        # --------------------------------------------

        nearest_distance = None


        for (
            a_id,
            b_id,
            a,
            b
        ) in segments:


            d = point_segment_distance(
                p,
                a,
                b
            )


            if (
                nearest_distance is None
                or d < nearest_distance
            ):

                nearest_distance = d


        # --------------------------------------------
        # FALLBACK
        # --------------------------------------------

        if nearest_distance is None:

            nearest_distance = float(
                "inf"
            )


        node_distances.append(
            nearest_distance
        )


        # --------------------------------------------
        # PROTECTED LANDMARK
        # --------------------------------------------

        if node_id in protected:

            keep_ids.append(
                node_id
            )

            kept_pts.append(
                p
            )

            continue


        # --------------------------------------------
        # REMOVE NODE
        # --------------------------------------------

        if nearest_distance <= clearance:

            remove_ids.append(
                node_id
            )

            removed_pts.append(
                p
            )


        # --------------------------------------------
        # KEEP NODE
        # --------------------------------------------

        else:

            keep_ids.append(
                node_id
            )

            kept_pts.append(
                p
            )


    # --------------------------------------------------------
    # OUTPUT
    # --------------------------------------------------------

    RemoveIDs = (
        remove_ids
    )

    KeepIDs = (
        keep_ids
    )


    RemovedPts = (
        removed_pts
    )

    KeptPts = (
        kept_pts
    )


    NodeDistances = (
        node_distances
    )


    RemoveCount = len(
        remove_ids
    )

    KeepCount = len(
        keep_ids
    )


    # --------------------------------------------------------
    # STATUS
    # --------------------------------------------------------

    Status = (

        "BYPASS CORRIDOR CALCULATED"

        + " | City nodes = "
        + str(
            node_count
        )

        + " | Bypass segments = "
        + str(
            len(
                segments
            )
        )

        + " | Clearance = "
        + str(
            round(
                clearance,
                2
            )
        )

        + " m"

        + " | Removed pods = "
        + str(
            RemoveCount
        )

        + " | Remaining pods = "
        + str(
            KeepCount
        )

        + " | Protected landmarks = "
        + str(
            len(
                protected
            )
        )

        + " | Invalid bypass connections = "
        + str(
            invalid_connections
        )
    )
# ---------- end bypass_pod_removal ----------
sphere_4 = Sphere(Base=bypass_pod_removal.RemovedPts, Radius="2")
custom_preview_5 = CustomPreview(Geometry=sphere_4, Material=ColourSwatch(SwatchColor=RGB(255, 229, 0)))

# ---- group: BYPASS HIGHWAY / CITY SCALE
list_item_start = ListItem(List=search_nodes, Index=hierarchical_bypass_network.CityStartIDs, Wrap=True)
list_item_end = ListItem(List=search_nodes, Index=hierarchical_bypass_network.CityEndIDs, Wrap=True)
line_4 = Line(StartPoint=list_item_start, EndPoint=list_item_end)
colour_swatch_2 = ColourSwatch(SwatchColor=RGB(255, 0, 238))
custom_preview_6 = CustomPreview(Geometry=line_4, Material=colour_swatch_2)
custom_preview_7 = CustomPreview(Geometry=list_item_start, Material=colour_swatch_2)

# ---- group: BYPASS HIGHWAY / DISTRICT SCALE
list_item_start_2 = ListItem(List=search_nodes, Index=hierarchical_bypass_network.DistrictStartIDs, Wrap=True)
list_item_end_2 = ListItem(List=search_nodes, Index=hierarchical_bypass_network.DistrictEndIDs, Wrap=True)
line_5 = Line(StartPoint=list_item_start_2, EndPoint=list_item_end_2)
colour_swatch_3 = ColourSwatch(SwatchColor=RGB(64, 0, 255))
custom_preview_8 = CustomPreview(Geometry=line_5, Material=colour_swatch_3)
custom_preview_9 = CustomPreview(Geometry=list_item_start_2, Material=colour_swatch_3)

# ---- group: BYPASS HIGHWAY / CLUSTER SCALE
list_item_start_3 = ListItem(List=search_nodes, Index=hierarchical_bypass_network.ClusterStartIDs, Wrap=True)
list_item_end_3 = ListItem(List=search_nodes, Index=hierarchical_bypass_network.ClusterEndIDs, Wrap=True)
line_6 = Line(StartPoint=list_item_start_3, EndPoint=list_item_end_3)
colour_swatch_4 = ColourSwatch(SwatchColor=RGB(0, 255, 200))
custom_preview_10 = CustomPreview(Geometry=line_6, Material=colour_swatch_4)
custom_preview_11 = CustomPreview(Geometry=list_item_start_3, Material=colour_swatch_4)

# ----
merge_3 = Merge(Data1=line_4, Data2=line_5, Data3=line_6)

# ---- group: 03_CITY DISTRICT GRID (continued)
city_grid = Merge(Data1=horizontal_edges, Data2=vertical_edges, Data3=inter_district_edges, Data4=merge_3)
list_length_9 = ListLength(List=flatten(city_grid))
all_graph_edges = Panel(list_length_9)

# ---- group: A* Search Algorythm (continued)
search_edges = Curve(flatten(city_grid))
a_metadata = Script(
    Nodes=search_nodes,
    Edges=search_edges,
    Start=start_point,
    Goal=goal_point,
    DistrictCount=district_count,
    LevelCount=levels_z,
    UpFactor=up_factor,
    TurnPenalty=turn_penalty,
    HorizontalAfterVerticalPenalty=horizontal_after_vertical_penalty,
    PositionsPerLevel=base_horizontal_edges,
    Programs=city_database_script.NodePrograms,
    Categories=city_database_script.NodeCategories)  # -> PathPts, PathEdges, PathIDs, PathLabels, PathPrograms, PathCategories, Cost, StartLabel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; inputs Nodes: list of Point3d, Edges: list of Curve, Start: Point3d, Goal: Point3d, UpFactor: Int32, TurnPenalty: Int32, HorizontalAfterVerticalPenalty: Int32, Programs: list of String, Categories: list of String
# ---------- a_metadata: Python ----------
import heapq
import Rhino.Geometry as rg


# ------------------------------------------------------------
# DEFAULT OUTPUTS
# ------------------------------------------------------------

PathPts = []
PathEdges = []
PathIDs = []
PathLabels = []
PathPrograms = []
PathCategories = []

Cost = None
PhysicalDistance = 0.0
VerticalDistance = 0.0
TurnCount = 0

Visited = 0
Status = ""

StartLabel = ""
GoalLabel = ""

StartNeighbors = []
StartNeighborCosts = []
StartNeighborInfo = []


# ------------------------------------------------------------
# BASIC CHECK
# ------------------------------------------------------------

if not Nodes or not Edges:

    Status = "ERROR: Nodes or Edges are empty."

elif Start is None or Goal is None:

    Status = "ERROR: Start or Goal is missing."

else:

    nodes = list(Nodes)
    edges = list(Edges)

    district_count = int(DistrictCount)
    level_count = int(LevelCount)
    positions_per_level = int(PositionsPerLevel)

    # --------------------------------------------------------
    # COST SETTINGS
    # --------------------------------------------------------

    up_factor = max(
        1.0,
        float(UpFactor)
    )

    turn_penalty = max(
        0.0,
        float(TurnPenalty)
    )

    horizontal_after_vertical_penalty = max(
        0.0,
        float(HorizontalAfterVerticalPenalty)
    )

    vertical_tolerance = 0.001


    # --------------------------------------------------------
    # NODE ID DECODER
    # --------------------------------------------------------
    #
    # Flattened node order:
    #
    # Position
    #   → Level
    #       → District
    #
    # ID =
    # position * (levels * districts)
    # + level * districts
    # + district
    #

    nodes_per_position = (
        level_count
        * district_count
    )


    def decode_node_id(node_id):

        position = (
            node_id
            // nodes_per_position
        )

        remainder = (
            node_id
            % nodes_per_position
        )

        level = (
            remainder
            // district_count
        )

        district = (
            remainder
            % district_count
        )

        return (
            district,
            level,
            position
        )


    def node_label(node_id):

        district, level, position = (
            decode_node_id(node_id)
        )

        return (
            "ID {} | D{:02d} | L{:02d} | P{:02d}"
            .format(
                node_id,
                district + 1,
                level + 1,
                position + 1
            )
        )


    # --------------------------------------------------------
    # OPTIONAL PARAMETER CHECK
    # --------------------------------------------------------

    expected_nodes = (
        district_count
        * level_count
        * positions_per_level
    )

    metadata_warning = ""

    if expected_nodes != len(nodes):

        metadata_warning = (
            " | WARNING: metadata expects "
            + str(expected_nodes)
            + " nodes but graph contains "
            + str(len(nodes))
        )


    # --------------------------------------------------------
    # POINT KEY
    # --------------------------------------------------------

    def point_key(p):

        return (
            round(p.X, 6),
            round(p.Y, 6),
            round(p.Z, 6)
        )


    # --------------------------------------------------------
    # BUILD NODE LOOKUP
    # --------------------------------------------------------

    node_lookup = {}

    for i, pt in enumerate(nodes):

        node_lookup[
            point_key(pt)
        ] = i


    # --------------------------------------------------------
    # BUILD GRAPH / ADJACENCY LIST
    # --------------------------------------------------------

    adjacency = [
        []
        for _ in range(len(nodes))
    ]

    skipped_edges = 0


    for edge in edges:

        try:

            a = edge.PointAtStart
            b = edge.PointAtEnd

            length = edge.GetLength()

        except:

            skipped_edges += 1
            continue


        a_id = node_lookup.get(
            point_key(a)
        )

        b_id = node_lookup.get(
            point_key(b)
        )


        if (
            a_id is None
            or b_id is None
        ):

            skipped_edges += 1
            continue


        # Bidirectional graph

        adjacency[a_id].append(
            (
                b_id,
                length
            )
        )

        adjacency[b_id].append(
            (
                a_id,
                length
            )
        )


    # --------------------------------------------------------
    # FIND NEAREST GRAPH NODE TO START / GOAL
    # --------------------------------------------------------

    start_id = min(
        range(len(nodes)),
        key=lambda i:
        nodes[i].DistanceTo(Start)
    )

    goal_id = min(
        range(len(nodes)),
        key=lambda i:
        nodes[i].DistanceTo(Goal)
    )


    StartLabel = node_label(
        start_id
    )

    GoalLabel = node_label(
        goal_id
    )


    # --------------------------------------------------------
    # START NODE NEIGHBOR INFORMATION
    # --------------------------------------------------------

    StartNeighbors = [
        neighbor
        for neighbor, cost
        in adjacency[start_id]
    ]


    StartNeighborCosts = [
        cost
        for neighbor, cost
        in adjacency[start_id]
    ]


    StartNeighborInfo = []

    for neighbor, cost in adjacency[start_id]:

        text = (
            node_label(neighbor)
            + " | Physical edge length = "
            + str(round(cost, 2))
            + " m"
        )

        StartNeighborInfo.append(
            text
        )


    # --------------------------------------------------------
    # MOVEMENT TYPE
    # --------------------------------------------------------
    #
    # 0 = START
    # 1 = HORIZONTAL
    # 2 = VERTICAL
    #

    def movement_type(a_id, b_id):

        a = nodes[a_id]
        b = nodes[b_id]

        dz = (
            b.Z
            - a.Z
        )

        if abs(dz) > vertical_tolerance:

            return (
                2,
                dz
            )

        return (
            1,
            dz
        )


    # --------------------------------------------------------
    # A* HEURISTIC
    # --------------------------------------------------------
    #
    # Straight-line 3D distance remains a valid
    # lower bound because all added penalties are positive.
    #

    def heuristic(node_id):

        return (
            nodes[node_id]
            .DistanceTo(
                nodes[goal_id]
            )
        )


    # --------------------------------------------------------
    # A* SEARCH WITH MOVEMENT HISTORY
    # --------------------------------------------------------
    #
    # State stores:
    #
    # (
    #   node ID,
    #   previous movement type,
    #   has vertical movement already started?
    # )
    #
    # This is necessary because reaching the same node
    # horizontally and vertically can lead to different
    # future costs.
    #

    infinity = float("inf")


    start_state = (
        start_id,
        0,
        False
    )


    g_score = {
        start_state: 0.0
    }


    came_from = {}


    open_set = []

    heapq.heappush(
        open_set,
        (
            heuristic(start_id),
            0.0,
            start_state
        )
    )


    closed_states = set()

    visited_node_ids = set()

    found = False

    goal_state = None


    while open_set:

        (
            f_current,
            g_current,
            current_state
        ) = heapq.heappop(
            open_set
        )


        current_id = (
            current_state[0]
        )

        previous_mode = (
            current_state[1]
        )

        vertical_started = (
            current_state[2]
        )


        # ----------------------------------------------------
        # IGNORE OUTDATED QUEUE ENTRIES
        # ----------------------------------------------------

        if g_current > g_score.get(
            current_state,
            infinity
        ):

            continue


        # ----------------------------------------------------
        # GOAL REACHED
        # ----------------------------------------------------

        if current_id == goal_id:

            found = True

            goal_state = (
                current_state
            )

            break


        # ----------------------------------------------------
        # SKIP ALREADY CLOSED STATE
        # ----------------------------------------------------

        if current_state in closed_states:

            continue


        closed_states.add(
            current_state
        )

        visited_node_ids.add(
            current_id
        )


        # ----------------------------------------------------
        # CHECK ALL NEIGHBORS
        # ----------------------------------------------------

        for (
            neighbor,
            physical_length
        ) in adjacency[current_id]:


            (
                move_mode,
                dz
            ) = movement_type(
                current_id,
                neighbor
            )


            # --------------------------------------------
            # BASE COST
            # --------------------------------------------
            #
            # Start from actual geometric distance.
            #

            step_cost = (
                physical_length
            )


            # --------------------------------------------
            # GRAVITY / UPWARD MOVEMENT PENALTY
            # --------------------------------------------
            #
            # Moving upward costs more.
            #
            # Example:
            #
            # 7 m upward
            # × 1.30
            # = 9.1 cost units
            #

            if dz > vertical_tolerance:

                step_cost *= (
                    up_factor
                )


            # --------------------------------------------
            # DIRECTION CHANGE / TURN PENALTY
            # --------------------------------------------
            #
            # Penalize:
            #
            # horizontal → vertical
            # vertical   → horizontal
            #
            # Do not penalize the first movement.
            #

            if (
                previous_mode != 0
                and previous_mode != move_mode
            ):

                step_cost += (
                    turn_penalty
                )


            # --------------------------------------------
            # HORIZONTAL AFTER VERTICAL PENALTY
            # --------------------------------------------
            #
            # Once vertical movement has begun,
            # strongly discourage returning to
            # horizontal movement.
            #
            # Preferred:
            #
            # H H H H H V V V V V
            #
            # Discouraged:
            #
            # H V H V H V H
            #

            if (
                vertical_started
                and move_mode == 1
            ):

                step_cost += (
                    horizontal_after_vertical_penalty
                )


            # --------------------------------------------
            # UPDATE VERTICAL PHASE
            # --------------------------------------------

            new_vertical_started = (
                vertical_started
                or move_mode == 2
            )


            # --------------------------------------------
            # CREATE NEXT STATE
            # --------------------------------------------

            neighbor_state = (
                neighbor,
                move_mode,
                new_vertical_started
            )


            # --------------------------------------------
            # CALCULATE TOTAL COST
            # --------------------------------------------

            tentative_g = (
                g_score[current_state]
                + step_cost
            )


            # --------------------------------------------
            # BETTER ROUTE FOUND
            # --------------------------------------------

            if tentative_g < g_score.get(
                neighbor_state,
                infinity
            ):

                came_from[
                    neighbor_state
                ] = current_state


                g_score[
                    neighbor_state
                ] = tentative_g


                f_score = (
                    tentative_g
                    + heuristic(
                        neighbor
                    )
                )


                heapq.heappush(
                    open_set,
                    (
                        f_score,
                        tentative_g,
                        neighbor_state
                    )
                )


    # --------------------------------------------------------
    # VISITED NODES
    # --------------------------------------------------------

    Visited = len(
        visited_node_ids
    )


    # --------------------------------------------------------
    # RECONSTRUCT PATH
    # --------------------------------------------------------

    if found:

        # ----------------------------------------------------
        # RECONSTRUCT STATE PATH
        # ----------------------------------------------------

        state_path = [
            goal_state
        ]

        current_state = (
            goal_state
        )


        while (
            current_state
            != start_state
        ):

            current_state = (
                came_from[
                    current_state
                ]
            )

            state_path.append(
                current_state
            )


        state_path.reverse()


        # ----------------------------------------------------
        # EXTRACT NODE IDs
        # ----------------------------------------------------

        path_ids = [
            state[0]
            for state in state_path
        ]


        # ----------------------------------------------------
        # PATH IDs
        # ----------------------------------------------------

        PathIDs = (
            path_ids
        )


        # ----------------------------------------------------
        # PATH PROGRAMMES
        # ----------------------------------------------------

        if Programs:

            PathPrograms = [
                Programs[i]
                for i in path_ids
            ]

        else:

            PathPrograms = []


        # ----------------------------------------------------
        # PATH CATEGORIES
        # ----------------------------------------------------

        if Categories:

            PathCategories = [
                Categories[i]
                for i in path_ids
            ]

        else:

            PathCategories = []


        # ----------------------------------------------------
        # HUMAN-READABLE LABELS
        # ----------------------------------------------------

        PathLabels = [
            node_label(i)
            for i in path_ids
        ]


        # ----------------------------------------------------
        # PATH POINTS
        # ----------------------------------------------------

        PathPts = [
            nodes[i]
            for i in path_ids
        ]


        # ----------------------------------------------------
        # PATH EDGES
        # ----------------------------------------------------

        path_edges = []

        for i in range(
            len(PathPts) - 1
        ):

            line = rg.Line(
                PathPts[i],
                PathPts[i + 1]
            )

            path_edges.append(
                line
            )


        PathEdges = (
            path_edges
        )


        # ----------------------------------------------------
        # WEIGHTED TOTAL COST
        # ----------------------------------------------------

        Cost = (
            g_score[
                goal_state
            ]
        )


        # ----------------------------------------------------
        # PHYSICAL DISTANCE
        # ----------------------------------------------------

        PhysicalDistance = 0.0

        for i in range(
            len(PathPts) - 1
        ):

            PhysicalDistance += (
                PathPts[i]
                .DistanceTo(
                    PathPts[i + 1]
                )
            )


        # ----------------------------------------------------
        # VERTICAL DISTANCE
        # ----------------------------------------------------

        VerticalDistance = 0.0

        for i in range(
            len(PathPts) - 1
        ):

            dz = abs(
                PathPts[i + 1].Z
                - PathPts[i].Z
            )

            if (
                dz
                > vertical_tolerance
            ):

                VerticalDistance += (
                    dz
                )


        # ----------------------------------------------------
        # COUNT DIRECTION CHANGES
        # ----------------------------------------------------

        movement_modes = []

        for i in range(
            len(path_ids) - 1
        ):

            mode, dz = (
                movement_type(
                    path_ids[i],
                    path_ids[i + 1]
                )
            )

            movement_modes.append(
                mode
            )


        TurnCount = 0


        for i in range(
            1,
            len(movement_modes)
        ):

            if (
                movement_modes[i]
                != movement_modes[i - 1]
            ):

                TurnCount += 1


        # ----------------------------------------------------
        # STATUS
        # ----------------------------------------------------

        Status = (
            "PATH FOUND"
            + " | "
            + str(len(path_ids))
            + " nodes"
            + " | Physical distance = "
            + str(
                round(
                    PhysicalDistance,
                    2
                )
            )
            + " m"
            + " | Weighted cost = "
            + str(
                round(
                    Cost,
                    2
                )
            )
            + " | Turns = "
            + str(
                TurnCount
            )
            + " | Vertical distance = "
            + str(
                round(
                    VerticalDistance,
                    2
                )
            )
            + " m"
            + " | Visited = "
            + str(
                Visited
            )
            + " | Skipped edges = "
            + str(
                skipped_edges
            )
            + metadata_warning
        )


    else:

        Status = (
            "NO PATH FOUND. "
            "Start and Goal may belong to disconnected districts."
            + " | Visited = "
            + str(
                Visited
            )
            + " | Skipped edges = "
            + str(
                skipped_edges
            )
            + metadata_warning
        )
# ---------- end a_metadata ----------
custom_preview_12 = CustomPreview(Geometry=a_metadata.PathEdges, Material=colour_swatch)
path_ids = Panel(a_metadata.PathIDs)
path_labels = Panel(a_metadata.PathLabels)
path_programs = Panel(a_metadata.PathPrograms)
path_categories = Panel(a_metadata.PathCategories)
cost_m = Panel(a_metadata.Cost)
start_label = Panel(a_metadata.StartLabel)
goal_label = Panel(a_metadata.GoalLabel)
visited = Panel(a_metadata.Visited)
status_4 = Panel(a_metadata.Status)
start_neighbors = Panel(a_metadata.StartNeighbors)
start_neighbor_costs = Panel(a_metadata.StartNeighborCosts)
start_neighbor_info = Panel(a_metadata.StartNeighborInfo)
